# Grasshopper definition Color encoder component doesn't work.gh (Grasshopper 1.0.7)
# plug-ins: Thesistheamazingtwo

repeat_data = RepeatData(Data=ColourSwatch(SwatchColor=RGB(255, 255, 255)), Length=Slider(10, range=0..10))
cencoder = CEncoder(InputColors=repeat_data)  # -> UniqueElements, EncodedList
panel = Panel(cencoder.UniqueElements)
panel_2 = Panel(cencoder.EncodedList)
