# Grasshopper definition Encoding and mod synthesis first success.gh (Grasshopper 1.0.7)
# plug-ins: Thesistheamazingtwo

# ---- group: BINARY ENCODING
brep = Brep([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])
brep_2 = Brep([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])
series = Series(Start=Slider(0, range=0..100), Step=Slider(100, range=0..100), Count=Slider(6, range=0..10))

# ---- group: BINARY ENCODING / Binary Encoder
encoder = Encoder(InputVoxels=brep, InputChuncks=brep_2)  # -> graft(BinaryCode)

# ---- group: BINARY ENCODING / we get one code for every voxel
param_viewer = ParamViewer(encoder)

# ---- group: BINARY ENCODING (continued)
panel = Panel(encoder)
text_fragment = TextFragment(Text=encoder, Start=series, Count=Slider(100, range=0..100))  # -> graft(Fragment)
ghpython_script = GhPythonScript(x=encoder)  # -> out, a
# ---------- ghpython_script: Python ----------
__author__ = "Eleni"
__version__ = "2020.06.24"

import rhinoscriptsyntax as rs

a = hex(int(x, 2))
# ---------- end ghpython_script ----------
panel_2 = Panel(ghpython_script.a)
panel_3 = Panel(text_fragment)

# ---- group: BINARY ENCODING / we split the codes per face
param_viewer_2 = ParamViewer(text_fragment)

# ---- group: BINARY ENCODING / Convert the codes to hexadecimal
ghpython_script_2 = GhPythonScript(x=panel_3)  # -> out, a; same code as ghpython_script

# ---- group: BINARY ENCODING (continued)
trim_tree = TrimTree(Tree=ghpython_script_2.a, Depth=1)  # -> simplify(Tree)
panel_4 = Panel(trim_tree)
text_join = TextJoin(Text=panel_4)
panel_5 = Panel(text_join)

# ---- group: BINARY ENCODING / for all the voxels we get 6 hexadecimals, one for each face
param_viewer_3 = ParamViewer(trim_tree)

# ---- group: UNIQUE INDEX LIST
encoder_2 = CSharpScript(Codes=flatten(panel_5))  # -> out, Unique, Encoded, Decoded; inputs Codes: list of String
# ---------- encoder_2: C# usings ----------
using System.Drawing;
# ---------- encoder_2: C# ----------
    //get the unique items from the color list
    var unique_items = new HashSet<string>(Codes);


    //create an array with the unique colors
    string [] unique_array = new string[unique_items.Count + 1];
    unique_items.CopyTo(unique_array, 1);
    Unique = unique_array;

    //encode the list of colors based on the indices in the unique array
    var encoded_list = new List<int>();
    for (int i = 0; i < Codes.Count; i++)
    {
      for (int j = 0; j < unique_array.Length; j++)
      {
        if(unique_array[j] == Codes[i])
        {
          encoded_list.Add(j);

        }
      }
    }
    Encoded = encoded_list;


    //decode the list to retrieve the color values
    var decoded_list = new List<string>();
    
    for (int i = 0; i < encoded_list.Count; i++)
    {
      for (int j = 0; j < unique_array.Length; j++)
      {
        if(encoded_list[i] == j)
        {
          decoded_list.Add(unique_array[j]);
        }

      }

    }
    Decoded = decoded_list;
# ---------- end encoder_2 ----------
unique = Panel(encoder_2.Unique)
encoded = Panel(encoder_2.Encoded)

# ---- group: PROBABILISTIC MODEL SYNTHESIS
y = Slider(6, range=0..10)
x = Slider(6, range=0..10)
z = Slider(1, range=0..10)
y_2 = Slider(6, range=0..10)
x_2 = Slider(6, range=0..100)
z_2 = Slider(1, range=0..10)
vector_xyz = VectorXYZ(XComponent=x, YComponent=y, ZComponent=z)  # -> Vector, Length
vector_xyz_2 = VectorXYZ(XComponent=x_2, YComponent=y_2, ZComponent=z_2)  # -> Vector, Length
ps = Slider(1, range=0..10)
model_synthesis = ModelSynthesis(
    InputModel=brep,
    InputValues=encoder_2.Encoded,
    PatternSize=ps,
    InputSize=vector_xyz_2.Vector,
    OutputSize=vector_xyz.Vector,
    Probabilistic=Toggle(True),
    Periodic=Toggle(True),
    Generate=Button())  # -> OutputModel, OutputValues, Patterns, Probabilities
panel_6 = Panel(model_synthesis.Patterns)
panel_7 = Panel(model_synthesis.OutputValues)
panel_8 = Panel(model_synthesis.Probabilities)

# ---- group: SURFACE REPRESENTATION
area = Area(Geometry=model_synthesis.OutputModel)  # -> Area, Centroid
list_item = ListItem(List=brep_2, Index=panel_7, Wrap=True)
geometry = Geometry(list_item)
area_2 = Area(Geometry=geometry)  # -> Area, Centroid
vector_2pt = Vector2Pt(PointA=area_2.Centroid, PointB=area.Centroid, Unitize=False)  # -> Vector, Length
move = Move(Geometry=geometry, Motion=vector_2pt.Vector)  # -> Geometry, Transform
geometry_2 = Geometry(move.Geometry)
