# Grasshopper definition Experiments with encoding binary hexa string.gh (Grasshopper 1.0.7)
# plug-ins: Thesistheamazingtwo

# ---- group: We can convert the binary code of every voxel to hexadecimal but how do you define the permutations? I am getting the same code because I rotated both voxels and chuncks
surface = Surface([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])
brep = Brep([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])
encoder = Encoder(InputVoxels=brep, InputChuncks=surface)  # -> graft(BinaryCode)
panel = Panel(encoder)
param_viewer = ParamViewer(encoder)
ghpython_script = GhPythonScript(x=encoder)  # -> out, flatten(a)
# ---------- ghpython_script: Python ----------
__author__ = "Eleni"
__version__ = "2020.06.24"

import rhinoscriptsyntax as rs

a = hex(int(x, 2))
# ---------- end ghpython_script ----------
panel_2 = Panel(ghpython_script.a)

# ---- group: Binary encoder
brep_2 = Brep([<brep referenced from the Rhino model> x4])
brep_3 = Brep([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])
encoder_2 = Encoder(InputVoxels=brep_3, InputChuncks=brep_2)  # -> graft(BinaryCode)

# ----
brep_4 = Brep([<brep referenced from the Rhino model> x4])

# ---- group: Binary encoder
brep_5 = Brep([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])
encoder_3 = Encoder(InputVoxels=brep_5, InputChuncks=brep_4)  # -> graft(BinaryCode)

# ----
brep_6 = Brep([<brep referenced from the Rhino model> x4])
deconstruct_brep = DeconstructBrep(Brep=brep_6)  # -> Faces, Edges, Vertices
area = Area(Geometry=deconstruct_brep.Faces)  # -> Area, Centroid
item_index = ItemIndex(List=deconstruct_brep.Faces, Item=deconstruct_brep.Faces)
text_tag = TextTag(Location=area.Centroid, Text=item_index, Colour=ColourSwatch(SwatchColor=RGB(255, 255, 255)))

number_slider = Slider(0, range=0..100)

# ---- group: What if the codes we get from the rotated versions of a chunck have some sort of similarity? a number that help us associate them?identify them?
brep_7 = Brep([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])
surface_2 = Surface([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])
encoder_4 = Encoder(InputVoxels=brep_7, InputChuncks=surface_2)  # -> graft(BinaryCode)
panel_3 = Panel(encoder_4)
param_viewer_2 = ParamViewer(encoder_4)
ghpython_script_2 = GhPythonScript(x=encoder_4)  # -> out, flatten(a); same code as ghpython_script
panel_4 = Panel(ghpython_script_2.a)
text_length = TextLength(Text=panel_4)
panel_5 = Panel(text_length)
list_item = ListItem(List=panel_4, Index=Slider(0, range=0..100), Wrap=True)  # -> Item, Item1, Item2, Item3, Item4, Item5

# ---- group: What if the codes we get from the rotated versions of a chunck have some sort of similarity? a number that help us associate them?identify them? / if for different chuncks the value of Levenstein distance was same or in a constant range that would be CONVENIENT....but no...
text_distance = TextDistance(
    TextA=list_item.Item,
    TextB=[list_item.Item1, list_item.Item2, list_item.Item3, list_item.Item4, list_item.Item5],
    Case=True)

# ---- group: What if the codes we get from the rotated versions of a chunck have some sort of similarity? a number that help us associate them?identify them? (continued)
panel_6 = Panel(text_distance)

# ---- group: we get the full code and break it ber face and ther per line to find a way of comparison/ similarity among permutations
panel_7 = Panel(encoder_2)
text_length_2 = TextLength(Text=panel_7)  # -> flatten(Length)
panel_8 = Panel(text_length_2)
number_slider_2 = Slider(100, range=0..100)
series = Series(Start=Slider(0, range=0..100), Step=Slider(100, range=0..100), Count=Slider(6, range=0..10))
number_slider_3 = Slider(10, range=0..10)
series_2 = Series(Start=Slider(0, range=0..100), Step=number_slider_3, Count=Slider(10, range=0..10))

# ---- group: we get the full code and break it ber face and ther per line to find a way of comparison/ similarity among permutations / Break the code per face
text_fragment = TextFragment(Text=panel_7, Start=series, Count=number_slider_2)  # -> graft(Fragment)

# ----
list_item_2 = ListItem(List=text_fragment, Index=number_slider, Wrap=True)  # -> flatten(Item)

# ---- group: we get the full code and break it ber face and ther per line to find a way of comparison/ similarity among permutations (continued)
panel_9 = Panel(text_fragment)
param_viewer_3 = ParamViewer(panel_9)

# ----
panel_10 = Panel(list_item_2)
list_item_3 = ListItem(List=panel_10, Index=number_slider, Wrap=True)
panel_11 = Panel(list_item_3)

# ---- group: we get the full code and break it ber face and ther per line to find a way of comparison/ similarity among permutations / break the code per line
text_fragment_2 = TextFragment(Text=panel_9, Start=series_2, Count=number_slider_3)

# ---- group: convert binary to hexadecimal per line
ghpython_script_3 = GhPythonScript(x=text_fragment_2)  # -> out, simplify(a); same code as ghpython_script

# ---- group: Break the code per face and then per line
panel_12 = Panel(encoder_3)
text_length_3 = TextLength(Text=panel_12)  # -> flatten(Length)
panel_13 = Panel(text_length_3)
number_slider_4 = Slider(100, range=0..100)
series_3 = Series(Start=Slider(0, range=0..100), Step=Slider(100, range=0..100), Count=Slider(6, range=0..10))
number_slider_5 = Slider(10, range=0..10)
series_4 = Series(Start=Slider(0, range=0..100), Step=number_slider_5, Count=Slider(10, range=0..10))

# ---- group: Break the code per face and then per line / Break the code per face
text_fragment_3 = TextFragment(Text=panel_12, Start=series_3, Count=number_slider_4)  # -> graft(Fragment)

# ---- group: WORKS WORKS WORKS
c_script = CSharpScript(x=text_fragment_3)  # -> out, A; inputs x: String
# ---------- c_script: C# ----------
    A = BinToDec(x);
# ---------- c_script: C# additional code ----------
  public string BinToDec(string value)
  {
    // BigInteger can be found in the System.Numerics dll
    long res = 0;

    // I'm totally skipping error handling here
    foreach(char c in value)
    {
      res <<= 1;
      res += c == '1' ? 1 : 0;
    }

    //return ((int)res).ToString();
     return res.ToString();
  }
# ---------- end c_script ----------

# ----
trim_tree = TrimTree(Tree=c_script.A, Depth=1)  # -> simplify(Tree)
param_viewer_4 = ParamViewer(trim_tree)

# ---- group: Break the code per face and then per line (continued)
panel_14 = Panel(text_fragment_3)
param_viewer_5 = ParamViewer(panel_14)

# ----
panel_15 = Panel(trim_tree)
c_script_2 = CSharpScript(binary=text_fragment_3)  # -> out, A; inputs binary: list of String
# ---------- c_script_2: C# ----------
    List<int> Codes = new List <int>();
    foreach (var item in binary)
    {
      int series_code = Convert.ToInt32(item,16);
      Codes.Add(series_code);
    }
    A = Codes;
# ---------- end c_script_2 ----------

# ---- group: Break the code per face and then per line / break the code per line
text_fragment_4 = TextFragment(Text=panel_14, Start=series_4, Count=number_slider_5)

# ---- group: convert binary to hexadecimal per line
ghpython_script_4 = GhPythonScript(x=text_fragment_4)  # -> out, simplify(a); same code as ghpython_script

# ----
panel_16 = Panel(c_script_2.out)

# ---- group: binary to decimal / covert binary to decimal per line
c_script_3 = CSharpScript(binary=text_fragment_4)  # -> out, A; inputs binary: list of String
# ---------- c_script_3: C# ----------
    List<int> Codes = new List <int>();
    foreach (var item in binary)
    {
      int series_code = Convert.ToInt32(item,2);
      Codes.Add(series_code);
    }
    A = Codes;
# ---------- end c_script_3 ----------

# ---- group: Encoding to hexadecimal
ghpython_script_5 = GhPythonScript(x=encoder_2)  # -> out, flatten(a); same code as ghpython_script
panel_17 = Panel(ghpython_script_5.a)
text_length_4 = TextLength(Text=panel_17)
panel_18 = Panel(text_length_4)
list_item_4 = ListItem(List=panel_17, Index=Slider(0, range=0..100), Wrap=True)  # -> Item, Item1, Item2
text_distance_2 = TextDistance(TextA=list_item_4.Item, TextB=[list_item_4.Item1, list_item_4.Item2, list_item_4.Item], Case=True)
panel_19 = Panel(text_distance_2)

# ----
text_distance_3 = TextDistance(TextA=list_item_4.Item1, TextB=list_item_4.Item2, Case=True)

# ---- group: Encoding to hexadecimal (continued)
panel_20 = Panel(text_distance_3)

# ---- group: binary----> decimal(tried also addition,and Lenevstein)
panel_21 = Panel(text_fragment_2)

# ---- group: binary----> decimal(tried also addition,and Lenevstein) / covert binary to decimal per line
c_script_4 = CSharpScript(binary=panel_21)  # -> out, A; inputs binary: list of String; same code as c_script_3

# ----
trim_tree_2 = TrimTree(Tree=ghpython_script_4.a, Depth=1)
panel_22 = Panel(trim_tree_2)
i = Slider(0, range=0..100)

# ---- group: create final string for every voxel
c_script_5 = CSharpScript(x=panel_22)  # -> out, A; inputs x: list of String
# ---------- c_script_5: C# ----------
    string code = "";
    foreach (var item in x)
    {
      code += item;
    }
    A = code;
# ---------- end c_script_5 ----------

# ----
panel_23 = Panel(c_script_5.A)
text_length_5 = TextLength(Text=panel_23)
panel_24 = Panel(text_length_5)
list_item_5 = ListItem(List=flatten(c_script_5.A), Index=i, Wrap=True)  # -> Item, Item1, Item2, Item3
sort_text = SortText(Keys=panel_23, Culture=1033)  # -> Keys, Values
panel_25 = Panel(sort_text.Keys)
text_distance_4 = TextDistance(TextA=list_item_5.Item, TextB=[list_item_5.Item1, list_item_5.Item2, list_item_5.Item3], Case=True)
panel_26 = Panel(text_distance_4)
list_item_6 = ListItem(List=flatten(sort_text.Keys), Index=i, Wrap=True)  # -> Item, Item1, Item2, Item3
text_distance_5 = TextDistance(TextA=list_item_6.Item, TextB=[list_item_6.Item1, list_item_6.Item2, list_item_6.Item3, list_item_6.Item], Case=True)
match_text = MatchText(Text=list_item_6.Item, Pattern=list_item_6.Item, Case=Toggle(False))
panel_27 = Panel(text_distance_5)
panel_28 = Panel(match_text)

# ---- group: binary to decimal
trim_tree_3 = TrimTree(Tree=c_script_3.A, Depth=1)
param_viewer_6 = ParamViewer(trim_tree_3)
panel_29 = Panel(trim_tree_3)
mass_addition = MassAddition(Input=trim_tree_3)  # -> Result, PartialResults
panel_30 = Panel(mass_addition.Result)

# ---- group: binary to decimal / create final string for every voxel
c_script_6 = CSharpScript(x=panel_29)  # -> out, A; inputs x: list of String; same code as c_script_5

# ----
c_script_7 = CSharpScript(x=panel_29)  # -> out, A; inputs x: list of String; same code as c_script_5

# ---- group: binary to decimal (continued)
panel_31 = Panel(c_script_6.A)
text_length_6 = TextLength(Text=panel_31)
panel_32 = Panel(text_length_6)
list_item_7 = ListItem(List=flatten(c_script_6.A), Index=Slider(0, range=0..100), Wrap=True)  # -> Item, Item1, Item2, Item3
text_distance_6 = TextDistance(
    TextA=list_item_7.Item,
    TextB=[list_item_7.Item1, list_item_7.Item2, list_item_7.Item3, list_item_7.Item],
    Case=Toggle(True))
panel_33 = Panel(text_distance_6)

# ----
trim_tree_4 = TrimTree(Tree=ghpython_script_3.a, Depth=1)

# ---- group: create final string for every voxel
c_script_8 = CSharpScript(x=trim_tree_4)  # -> out, A; inputs x: list of String; same code as c_script_5

# ----
panel_34 = Panel(c_script_8.A)
text_length_7 = TextLength(Text=panel_34)
panel_35 = Panel(text_length_7)
list_item_8 = ListItem(List=flatten(c_script_8.A), Index=Slider(0, range=0..100), Wrap=True)  # -> Item, Item1, Item2, Item3
text_distance_7 = TextDistance(TextA=list_item_8.Item, TextB=[list_item_8.Item1, list_item_8.Item2, list_item_8.Item3], Case=True)
panel_36 = Panel(text_distance_7)

# ---- group: binary----> decimal(tried also addition,and Lenevstein) (continued)
trim_tree_5 = TrimTree(Tree=c_script_4.A, Depth=1)
param_viewer_7 = ParamViewer(trim_tree_5)
panel_37 = Panel(trim_tree_5)
mass_addition_2 = MassAddition(Input=trim_tree_5)  # -> Result, PartialResults
panel_38 = Panel(mass_addition_2.Result)

# ---- group: binary----> decimal(tried also addition,and Lenevstein) / create final string for every voxel
c_script_9 = CSharpScript(x=panel_37)  # -> out, A; inputs x: list of String; same code as c_script_5

# ---- group: binary----> decimal(tried also addition,and Lenevstein) (continued)
panel_39 = Panel(c_script_9.A)
text_length_8 = TextLength(Text=panel_39)
panel_40 = Panel(text_length_8)
list_item_9 = ListItem(List=flatten(c_script_9.A), Index=Slider(0, range=0..100), Wrap=True)  # -> Item, Item1, Item2, Item3
text_distance_8 = TextDistance(
    TextA=list_item_9.Item,
    TextB=[list_item_9.Item1, list_item_9.Item2, list_item_9.Item3, list_item_9.Item],
    Case=Toggle(True))
panel_41 = Panel(text_distance_8)

# ---- group: not this one works...
explode_tree = ExplodeTree(Data=trim_tree_5)  # -> Branch0, Branch1, Branch2, Branch3
relative_differences = RelativeDifferences(Values=[explode_tree.Branch0, explode_tree.Branch1, explode_tree.Branch2, explode_tree.Branch3])
mass_addition_3 = MassAddition(Input=relative_differences)  # -> Result, PartialResults
panel_42 = Panel(relative_differences)
panel_43 = Panel(mass_addition_3.Result)
