# Grasshopper definition Final list of hexa and ints.gh (Grasshopper 1.0.7)
# plug-ins: Thesistheamazingtwo

# ---- group: Enclosed Geometry
brep = Brep([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])

# ---- group: Boundary voxels
brep_2 = Brep([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])

# ---- group: Enclosed Geometry
brep_3 = Brep([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])

# ---- group: Boundary voxels
brep_4 = Brep([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])

# ----
list_item = ListItem(List=brep_4, Index=Slider(0, range=0..100), Wrap=True)
deconstruct_brep = DeconstructBrep(Brep=brep_2)  # -> Faces, Edges, Vertices

# ---- group: Binary Encoder
encoder = Encoder(InputVoxels=brep_2, InputChuncks=brep)  # -> graft(BinaryCode)

# ---- group: Enclosed Geometry
brep_5 = Brep([<brep referenced from the Rhino model> x4])

# ---- group: Boundary voxels
brep_6 = Brep([<brep referenced from the Rhino model> x4])

# ---- group: Binary Encoder
encoder_2 = Encoder(InputVoxels=brep_4, InputChuncks=brep_3)  # -> graft(BinaryCode)

# ---- group: Enclosed Geometry
brep_7 = Brep(<brep referenced from the Rhino model>)

# ---- group: Boundary voxels
brep_8 = Brep(<brep referenced from the Rhino model>)

# ----
custom_preview = CustomPreview(Geometry=brep_5, Material=ColourSwatch(SwatchColor=RGB(255, 0, 183)))
custom_preview_2 = CustomPreview(Geometry=brep_7, Material=ColourSwatch(SwatchColor=RGB(255, 0, 183)))
list_item_2 = ListItem(List=deconstruct_brep.Faces, Index=Slider(0, range=0..5), Wrap=True)

# ---- group: Binary Encoder
encoder_3 = Encoder(InputVoxels=brep_6, InputChuncks=brep_5)  # -> graft(BinaryCode)

encoder_4 = Encoder(InputVoxels=brep_8, InputChuncks=brep_7)  # -> graft(BinaryCode)

# ----
deconstruct_brep_2 = DeconstructBrep(Brep=brep_6)  # -> Faces, Edges, Vertices
deconstruct_brep_3 = DeconstructBrep(Brep=brep_8)  # -> Faces, Edges, Vertices
list_item_3 = ListItem(List=deconstruct_brep_2.Faces, Index=Slider(0, range=0..5), Wrap=True)
list_item_4 = ListItem(List=deconstruct_brep_3.Faces, Index=Slider(1, range=0..5), Wrap=True)

# ---- group: we get one code for every voxel
param_viewer = ParamViewer(encoder)

param_viewer_2 = ParamViewer(encoder_2)

param_viewer_3 = ParamViewer(encoder_3)

param_viewer_4 = ParamViewer(encoder_4)

# ----
series = Series(Start=Slider(0, range=0..100), Step=Slider(100, range=0..100), Count=Slider(6, range=0..10))
ghpython_script = GhPythonScript(x=encoder)  # -> out, a
# ---------- ghpython_script: Python ----------
__author__ = "Eleni"
__version__ = "2020.06.24"

import rhinoscriptsyntax as rs

a = hex(int(x, 2))
# ---------- end ghpython_script ----------
series_2 = Series(Start=Slider(0, range=0..100), Step=Slider(100, range=0..100), Count=Slider(6, range=0..10))
series_3 = Series(Start=Slider(0, range=0..100), Step=Slider(100, range=0..100), Count=Slider(6, range=0..10))
series_4 = Series(Start=Slider(0, range=0..100), Step=Slider(100, range=0..100), Count=Slider(6, range=0..10))
text_fragment = TextFragment(Text=encoder_2, Start=series, Count=Slider(100, range=0..100))  # -> graft(Fragment)
panel = Panel(ghpython_script.a)
text_fragment_2 = TextFragment(Text=encoder, Start=series_2, Count=Slider(100, range=0..100))  # -> graft(Fragment)
text_fragment_3 = TextFragment(Text=encoder_3, Start=series_3, Count=Slider(100, range=0..100))  # -> graft(Fragment)
text_fragment_4 = TextFragment(Text=encoder_4, Start=series_4, Count=Slider(100, range=0..100))  # -> graft(Fragment)

# ---- group: we split the codes per face
param_viewer_5 = ParamViewer(text_fragment)

# ----
panel_2 = Panel(text_fragment)

# ---- group: we split the codes per face
param_viewer_6 = ParamViewer(text_fragment_2)

# ----
panel_3 = Panel(text_fragment_2)

# ---- group: we split the codes per face
param_viewer_7 = ParamViewer(text_fragment_3)

# ----
panel_4 = Panel(text_fragment_3)

# ---- group: we split the codes per face
param_viewer_8 = ParamViewer(text_fragment_4)

# ----
panel_5 = Panel(text_fragment_4)

# ---- group: Convert Binary to integer
c_script = CSharpScript(x=panel_2)  # -> out, A; inputs x: String
# ---------- c_script: C# ----------
    A = BinToDec(x);
# ---------- c_script: C# additional code ----------
  public string BinToDec(string value)
  {
    // BigInteger can be found in the System.Numerics dll
    long res = 0;

    // I'm totally skipping error handling here
    foreach(char c in value)
    {
      res <<= 1;
      res += c == '1' ? 1 : 0;
    }

    //return ((int)res).ToString();
     return res.ToString();
  }
# ---------- end c_script ----------

# ---- group: Convert the codes to hexadecimal
ghpython_script_2 = GhPythonScript(x=panel_3)  # -> out, a; same code as ghpython_script

# ---- group: Convert Binary to integer
c_script_2 = CSharpScript(x=panel_4)  # -> out, A; inputs x: String; same code as c_script

# ----
trim_tree = TrimTree(Tree=c_script.A, Depth=1)  # -> simplify(Tree)

# ---- group: Convert Binary to integer
c_script_3 = CSharpScript(x=panel_5)  # -> out, A; inputs x: String; same code as c_script

# ----
trim_tree_2 = TrimTree(Tree=ghpython_script_2.a, Depth=1)  # -> simplify(Tree)
trim_tree_3 = TrimTree(Tree=c_script_2.A, Depth=1)  # -> simplify(Tree)
trim_tree_4 = TrimTree(Tree=c_script_3.A, Depth=1)  # -> simplify(Tree)
panel_6 = Panel(trim_tree)

# ---- group: For all the voxels we get 6 integers, one for each face
param_viewer_9 = ParamViewer(trim_tree)

# ----
panel_7 = Panel(trim_tree_2)

# ---- group: for all the voxels we get 6 hexadecimals, one for each face
param_viewer_10 = ParamViewer(trim_tree_2)

# ---- group: For all the voxels we get 6 integers, one for each face
param_viewer_11 = ParamViewer(trim_tree_3)

# ----
panel_8 = Panel(trim_tree_3)

# ---- group: For all the voxels we get 6 integers, one for each face
param_viewer_12 = ParamViewer(trim_tree_4)

# ----
panel_9 = Panel(trim_tree_4)
