# Grasshopper definition Mesh segmentation coding parts of it.gh (Grasshopper 1.0.7)
# plug-ins: MeshEdit Components, Thesistheamazingtwo, Human

number_slider = Slider(4, range=0..10)

# ---- group: VOXELS
geometry = Geometry([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])

# ---- group: GEOMETRIES
geometry_2 = Geometry([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])

# ----
domain_box = DomainBox(Base=PlaneXY(0, 0, 0), X=number_slider, Y=number_slider, Z=Domain(0, 0.25))
area = Area(Geometry=geometry)  # -> Area, Centroid
encoder = Encoder(InputVoxels=geometry, InputChuncks=geometry_2)  # -> BinaryCodes, UniqueBinaryCodes, EncodedList
bounds = Bounds(Numbers=encoder.EncodedList)
deconstruct_domain = DeconstructDomain(Domain=bounds)  # -> Start, End
box_array = BoxArray(Geometry=domain_box, Cell=domain_box, XCount=Slider(5, range=0..10), YCount=Slider(4, range=0..10), ZCount=2)  # -> Geometry, Transform
gradient = Gradient(
    LowerLimit=deconstruct_domain.Start,
    UpperLimit=deconstruct_domain.End,
    Parameter=encoder.EncodedList,
    stops=[0: RGB(243, 57, 0), 0.1: RGB(236, 27, 60), 0.2: RGB(210, 0, 118), 0.3: RGB(103, 0, 120), 0.4: RGB(39, 72, 161), 0.5: RGB(1, 192, 229), 0.6: RGB(18, 178, 90), 0.7: RGB(79, 186, 8), 0.8: RGB(220, 237, 32), 0.9: RGB(247, 159, 20), 1: RGB(243, 57, 0)])
text_tag = TextTag(Location=area.Centroid, Text=encoder.EncodedList, Colour=ColourSwatch(SwatchColor=RGB(255, 255, 255)))
brep_edges = BrepEdges(Brep=box_array.Geometry)  # -> Naked, Interior, NonManifold
panel = Panel(encoder.EncodedList)
panel_2 = Panel(encoder.UniqueBinaryCodes)
panel_3 = Panel(encoder.BinaryCodes)
custom_preview = CustomPreview(Geometry=geometry_2, Material=gradient)
custom_preview_lineweights = CustomPreviewLineweights(
    Geometry=brep_edges.Interior,
    Shader=ColourSwatch(SwatchColor=RGB(0, 0, 0)),
    Thickness=Slider(5.36, range=0..10),
    Absolute=False)
number_slider_2 = Slider(5, range=0..10)
number_slider_3 = Slider(4, range=0..10)

number_slider_4 = Slider(4, range=0..100)
number_slider_5 = Slider(6, range=0..10)
number_slider_6 = Slider(6, range=0..10)
number_slider_7 = Slider(4, range=1..10)
vector_xyz = VectorXYZ(XComponent=Slider(16, range=0..100), YComponent=Slider(12, range=0..100), ZComponent=number_slider_4)  # -> Vector, Length
vector_xyz_2 = VectorXYZ(XComponent=number_slider_5, YComponent=number_slider_6, ZComponent=Slider(1, range=0..10))  # -> Vector, Length
boolean_toggle = BooleanToggle(False)
boolean_toggle_2 = BooleanToggle(False)
model_synthesis = ModelSynthesis(
    InputModel=geometry,
    InputValues=encoder.EncodedList,
    PatternSize=number_slider_4,
    InputSize=vector_xyz.Vector,
    OutputSize=vector_xyz_2.Vector,
    Probabilistic=boolean_toggle,
    Periodic=boolean_toggle_2,
    Generate=Button())  # -> OutputModel, OutputValues, Patterns, Probabilities
panel_4 = Panel(model_synthesis.OutputValues)
panel_5 = Panel(model_synthesis.Patterns)
panel_6 = Panel(model_synthesis.Probabilities)

box_array_2 = BoxArray(Geometry=domain_box, Cell=domain_box, XCount=number_slider_5, YCount=number_slider_6, ZCount=2)  # -> Geometry, Transform
division = Division(A="1", B=2)
timer = Timer(TimerInterval=1000, Target=model_synthesis2)  # disabled
negative = Negative(Value=division)
model_synthesis2 = ModelSynthesis2(
    InputModel=geometry,
    InputValues=encoder.EncodedList,
    PatternSize=number_slider_4,
    InputSize=vector_xyz.Vector,
    OutputSize=vector_xyz_2.Vector,
    Probabilistic=boolean_toggle,
    Periodic=boolean_toggle_2,
    RESET=Button())  # -> OutputModel, OutputValues, Patterns, Probabilities
brep_edges_2 = BrepEdges(Brep=box_array_2.Geometry)  # -> Naked, Interior, NonManifold
vector_xyz_3 = VectorXYZ(XComponent=negative, YComponent=negative, ZComponent=0)  # -> Vector, Length
collection = Collection(
    OutputValues=model_synthesis.OutputValues,
    EncodedList=encoder.EncodedList,
    InputVoxels=geometry,
    InputChuncks=geometry_2)  # -> OutputUnique, MeshesFound, VoxelsFound
panel_7 = Panel(model_synthesis2.OutputValues)
panel_8 = Panel(model_synthesis2.Patterns)
panel_9 = Panel(model_synthesis2.Probabilities)
# info: This component gives all the tiles we will need to fill the output model.If number 3 exist in our output 5 times we will get the equivalent mesh and voxel also 5 times and in the corrent index.
decoder = Decoder(
    OutputModel=model_synthesis.OutputModel,
    OutputValues=model_synthesis.OutputValues,
    OutputUnique=collection.OutputUnique,
    MeshesCollection=collection.MeshesFound,
    VoxelsCollection=collection.VoxelsFound)  # -> OutputGeometries, VoxelsCenters
# info: Sometimes not all the tiles exist in the output model.This component gives the values that correspond to the unique elements that exist in the output model.It also gives the equivalent voxel ad the equavalent mesh.The 3 list given must have the same number of elements.
collection_2 = Collection(
    OutputValues=model_synthesis2.OutputValues,
    EncodedList=encoder.EncodedList,
    InputVoxels=geometry,
    InputChuncks=geometry_2)  # -> OutputUnique, MeshesFound, VoxelsFound
area_2 = Area(Geometry=model_synthesis.OutputModel)  # -> Area, Centroid
gradient_2 = Gradient(
    LowerLimit=deconstruct_domain.Start,
    UpperLimit=deconstruct_domain.End,
    Parameter=model_synthesis.OutputValues,
    stops=[0: RGB(243, 57, 0), 0.1: RGB(236, 27, 60), 0.2: RGB(210, 0, 118), 0.3: RGB(103, 0, 120), 0.4: RGB(39, 72, 161), 0.5: RGB(1, 192, 229), 0.6: RGB(18, 178, 90), 0.7: RGB(79, 186, 8), 0.8: RGB(220, 237, 32), 0.9: RGB(247, 159, 20), 1: RGB(243, 57, 0)])
# info: This component gives all the tiles we will need to fill the output model.If number 3 exist in our output 5 times we will get the equivalent mesh and voxel also 5 times and in the corrent index.
decoder_2 = Decoder(
    OutputModel=model_synthesis2.OutputModel,
    OutputValues=model_synthesis2.OutputValues,
    OutputUnique=collection_2.OutputUnique,
    MeshesCollection=collection_2.MeshesFound,
    VoxelsCollection=collection_2.VoxelsFound)  # -> OutputGeometries, VoxelsCenters
area_3 = Area(Geometry=model_synthesis2.OutputModel)  # -> Area, Centroid

# ---- group: Moving tiles and dislaying numbers
orient = Orient(Geometry=decoder.OutputGeometries, Source=decoder.VoxelsCenters, Target=area_2.Centroid)  # -> Geometry, Transform
r = Slider(22, range=0..100)
unit_x = UnitX(Factor=r)
move = Move(Geometry=orient.Geometry, Motion=unit_x)  # -> Geometry, Transform
mesh_area = MeshArea(Mesh=move.Geometry)  # -> Area, Centroid
custom_preview_2 = CustomPreview(Geometry=move.Geometry, Material=ColourSwatch(SwatchColor=RGBA(214, 115, 188, 202)))
text_tag_2 = TextTag(Location=mesh_area.Centroid, Text=model_synthesis.OutputValues, Colour=ColourSwatch(SwatchColor=RGB(255, 255, 255)))

# ----
move_2 = Move(Geometry=brep_edges_2.Interior, Motion=unit_x)  # -> Geometry, Transform
move_3 = Move(Geometry=move_2.Geometry, Motion=vector_xyz_3.Vector)  # -> Geometry, Transform
custom_preview_lineweights_2 = CustomPreviewLineweights(
    Geometry=move_3.Geometry,
    Shader=ColourSwatch(SwatchColor=RGB(0, 0, 0)),
    Thickness=Slider(5.36, range=0..10),
    Absolute=False)
custom_preview_3 = CustomPreview(Geometry=move.Geometry, Material=gradient_2)
area_4 = Area(Geometry=move.Geometry)  # -> Area, Centroid
gradient_3 = Gradient(
    LowerLimit=deconstruct_domain.Start,
    UpperLimit=deconstruct_domain.End,
    Parameter=model_synthesis2.OutputValues,
    stops=[0: RGB(243, 57, 0), 0.1: RGB(236, 27, 60), 0.2: RGB(210, 0, 118), 0.3: RGB(103, 0, 120), 0.4: RGB(39, 72, 161), 0.5: RGB(1, 192, 229), 0.6: RGB(18, 178, 90), 0.7: RGB(79, 186, 8), 0.8: RGB(220, 237, 32), 0.9: RGB(247, 159, 20), 1: RGB(243, 57, 0)])
# info: Our geometry is all the tiles that exist in the output model.Our source is the center of their boundary voxels in the input model, our target is the center of their boundary voxels in the output model.
orient_2 = Orient(Geometry=decoder_2.OutputGeometries, Source=decoder_2.VoxelsCenters, Target=area_3.Centroid)  # -> Geometry, Transform
text_tag_3 = TextTag(Location=area_4.Centroid, Text=model_synthesis.OutputValues, Colour=ColourSwatch(SwatchColor=RGB(255, 255, 255)))
r_2 = Slider(22, range=0..100)
unit_x_2 = UnitX(Factor=r_2)
move_4 = Move(Geometry=orient_2.Geometry, Motion=unit_x_2)  # -> Geometry, Transform
custom_preview_4 = CustomPreview(Geometry=move_4.Geometry, Material=gradient_3)
mesh_area_2 = MeshArea(Mesh=move_4.Geometry)  # -> Area, Centroid
custom_preview_5 = CustomPreview(Geometry=move_4.Geometry, Material=ColourSwatch(SwatchColor=RGB(204, 75, 188)))  # disabled
text_tag_4 = TextTag(Location=mesh_area_2.Centroid, Text=model_synthesis2.OutputValues, Colour=ColourSwatch(SwatchColor=RGB(255, 255, 255)))
