# Grasshopper definition Mesh segmentation pluw weaverbird.gh (Grasshopper 1.0.7)
# plug-ins: MeshEdit Components, Thesistheamazingtwo, Weaverbird

number_slider = Slider(0.5, range=0..1)
construct_point = ConstructPoint(XCoordinate=number_slider, YCoordinate=number_slider, ZCoordinate=number_slider)
number_slider_2 = Slider(0.5, range=0..1)
number_slider_3 = Slider(0.5, range=0..1)

# ---- group: Input surface
brep = Brep(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)
mesh_brep = MeshBrep(
    Brep=brep,
    Settings={GridMaxCount=0, GridMinCount=16, JaggedSeams=False, MaxEdgeLength=0, MinEdgeLength=0.0001, MinTolerance=0, Refine=True, RefineAngle=0, RelativeTolerance=0.65, SimplePlanes=True, Tolerance=0})

# ----
construct_plane = ConstructPlane(Origin=construct_point, XAxis=Vector(1, 0, 0), YAxis=Vector(0, 1, 0))
number_slider_4 = Slider(0.5, range=0..1)
construct_point_2 = ConstructPoint(XCoordinate=number_slider_2, YCoordinate=number_slider_2, ZCoordinate=number_slider_2)
number_slider_5 = Slider(0.5, range=0..1)
center_box = CenterBox(Base=construct_plane, X=number_slider_3, Y=number_slider_3, Z=number_slider_3)

# ---- group: Input surface
brep_2 = Brep(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)
mesh_brep_2 = MeshBrep(
    Brep=brep_2,
    Settings={GridMaxCount=0, GridMinCount=16, JaggedSeams=False, MaxEdgeLength=0, MinEdgeLength=0.0001, MinTolerance=0, Refine=True, RefineAngle=0, RelativeTolerance=0.65, SimplePlanes=True, Tolerance=0})

# ----
construct_plane_2 = ConstructPlane(Origin=construct_point_2, XAxis=Vector(1, 0, 0), YAxis=Vector(0, 1, 0))
construct_point_3 = ConstructPoint(XCoordinate=number_slider_4, YCoordinate=number_slider_4, ZCoordinate=number_slider_4)
number_slider_6 = Slider(0.5, range=0..1)
weaverbird_s_mesh_thicken = WeaverbirdsMeshThicken(MeshCurves=mesh_brep, Distance=Slider(0.1, range=0..1), OffsetType=0)
center_box_2 = CenterBox(Base=construct_plane_2, X=number_slider_5, Y=number_slider_5, Z=number_slider_5)

# ---- group: Input surface
brep_3 = Brep(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)
mesh_brep_3 = MeshBrep(
    Brep=brep_3,
    Settings={GridMaxCount=0, GridMinCount=16, JaggedSeams=False, MaxEdgeLength=0, MinEdgeLength=0.0001, MinTolerance=0, Refine=True, RefineAngle=0, RelativeTolerance=0.65, SimplePlanes=True, Tolerance=0})

# ----
construct_plane_3 = ConstructPlane(Origin=construct_point_3, XAxis=Vector(1, 0, 0), YAxis=Vector(0, 1, 0))
box_array = BoxArray(
    Geometry=center_box,
    Cell=center_box,
    XCount=Slider(8, range=0..100),
    YCount=Slider(1, range=0..100),
    ZCount=Slider(8, range=0..100))  # -> Geometry, Transform
mesh = Mesh(brep_3)
custom_preview = CustomPreview(Geometry=mesh, Material=ColourSwatch(SwatchColor=RGB(255, 35, 255)))
center_box_3 = CenterBox(Base=construct_plane_3, X=number_slider_6, Y=number_slider_6, Z=number_slider_6)
weaverbird_s_mesh_thicken_2 = WeaverbirdsMeshThicken(MeshCurves=mesh_brep_2, Distance=Slider(0.01, range=0..1), OffsetType=0)
simple_mesh = SimpleMesh(Brep=box_array.Geometry)
box_array_2 = BoxArray(
    Geometry=center_box_2,
    Cell=center_box_2,
    XCount=Slider(8, range=0..100),
    YCount=Slider(1, range=0..100),
    ZCount=Slider(8, range=0..100))  # -> Geometry, Transform
mesh_weldvertices = MeshWeldVertices(Mesh=simple_mesh, Tolerance=0.01)  # -> RuntimeMessage, Mesh
weaverbird_s_mesh_thicken_3 = WeaverbirdsMeshThicken(MeshCurves=mesh_brep_3, Distance=Slider(0.01, range=0..1), OffsetType=0)
simple_mesh_2 = SimpleMesh(Brep=box_array_2.Geometry)
graft_tree = GraftTree(Tree=mesh_weldvertices.Mesh, IncludeEmptyLists=True, IncludeNullItems=True)
brep_wireframe = BrepWireframe(Brep=box_array_2.Geometry, Density=-1)
box_array_3 = BoxArray(
    Geometry=center_box_3,
    Cell=center_box_3,
    XCount=Slider(8, range=0..100),
    YCount=Slider(1, range=0..100),
    ZCount=Slider(8, range=0..100))  # -> Geometry, Transform
mesh_intersection = MeshIntersection(MeshesA=weaverbird_s_mesh_thicken, MeshesB=graft_tree)  # -> simplify(Result)
mesh_weldvertices_2 = MeshWeldVertices(Mesh=simple_mesh_2, Tolerance=0.01)  # -> RuntimeMessage, Mesh
custom_preview_2 = CustomPreview(Geometry=weaverbird_s_mesh_thicken_2, Material=ColourSwatch(SwatchColor=RGBA(220, 14, 239, 136)))
simple_mesh_3 = SimpleMesh(Brep=box_array_3.Geometry)
brep_wireframe_2 = BrepWireframe(Brep=box_array_3.Geometry, Density=-1)
graft_tree_2 = GraftTree(Tree=mesh_weldvertices_2.Mesh, IncludeEmptyLists=True, IncludeNullItems=True)
number_slider_7 = Slider(99, range=0..100)
mesh_weldvertices_3 = MeshWeldVertices(Mesh=simple_mesh_3, Tolerance=0.01)  # -> RuntimeMessage, Mesh
mesh_intersection_2 = MeshIntersection(MeshesA=weaverbird_s_mesh_thicken_2, MeshesB=graft_tree_2)  # -> simplify(Result)
tree_statistics = TreeStatistics(Tree=mesh_intersection)  # -> Paths, Length, Count
tree_item = TreeItem(Tree=mesh_intersection, Path=tree_statistics.Paths, Index=0, Wrap=True)
graft_tree_3 = GraftTree(Tree=mesh_weldvertices_3.Mesh, IncludeEmptyLists=True, IncludeNullItems=True)
list_item = ListItem(List=tree_statistics.Paths, Index=number_slider_7, Wrap=True)
mesh_intersection_3 = MeshIntersection(MeshesA=weaverbird_s_mesh_thicken_3, MeshesB=graft_tree_3)  # -> simplify(Result)
number_slider_8 = Slider(99, range=0..100)
tree_statistics_2 = TreeStatistics(Tree=mesh_intersection_2)  # -> Paths, Length, Count

# ---- group: box
list_item_2 = ListItem(List=mesh_weldvertices.Mesh, Index=number_slider_7, Wrap=True)

# ---- group: mesh chunck
tree_branch = TreeBranch(Tree=mesh_intersection, Path=list_item, MaintainPaths=True)
custom_preview_3 = CustomPreview(Geometry=tree_branch, Material=ColourSwatch(SwatchColor=RGB(255, 46, 189)))

# ----
encoder = Encoder(InputVoxels=flatten(box_array.Geometry), InputChuncks=tree_item)  # -> BinaryCode, UniqueBinaryCodes, EncodedList
panel = Panel(tree_item)
tree_item_2 = TreeItem(Tree=mesh_intersection_2, Path=tree_statistics_2.Paths, Index=0, Wrap=True)
list_item_3 = ListItem(List=tree_statistics_2.Paths, Index=number_slider_8, Wrap=True)
number_slider_9 = Slider(84, range=0..100)
tree_statistics_3 = TreeStatistics(Tree=mesh_intersection_3)  # -> Paths, Length, Count

# ---- group: box
list_item_4 = ListItem(List=mesh_weldvertices_2.Mesh, Index=number_slider_8, Wrap=True)

# ---- group: mesh chunck
tree_branch_2 = TreeBranch(Tree=mesh_intersection_2, Path=list_item_3, MaintainPaths=True)
custom_preview_4 = CustomPreview(Geometry=tree_branch_2, Material=ColourSwatch(SwatchColor=RGB(255, 46, 189)))

# ----
encoder_2 = Encoder(InputVoxels=flatten(box_array_2.Geometry), InputChuncks=tree_item_2)  # -> BinaryCode, UniqueBinaryCodes, EncodedList
panel_2 = Panel(tree_item_2)
tree_item_3 = TreeItem(Tree=mesh_intersection_3, Path=tree_statistics_3.Paths, Index=0, Wrap=True)
panel_3 = Panel(encoder.BinaryCode)
list_item_5 = ListItem(List=tree_statistics_3.Paths, Index=number_slider_9, Wrap=True)

# ---- group: box
list_item_6 = ListItem(List=mesh_weldvertices_3.Mesh, Index=number_slider_9, Wrap=True)

# ---- group: mesh chunck
tree_branch_3 = TreeBranch(Tree=mesh_intersection_3, Path=list_item_5, MaintainPaths=True)

# ----
encoder_3 = Encoder(InputVoxels=box_array_3.Geometry, InputChuncks=tree_item_3)  # -> BinaryCodes, UniqueBinaryCodes, EncodedList
panel_4 = Panel(tree_item_3)
panel_5 = Panel(encoder_2.BinaryCode)
panel_6 = Panel(encoder_3.EncodedList)

# ---- group: UNIQUE INDEX LIST
encoder_4 = CSharpScript(Codes=flatten(panel_3), Chuncks=tree_item)  # -> out, Unique, Encoded, Decoded; inputs Codes: list of String, Chuncks: list of Mesh
# ---------- encoder_4: C# usings ----------
using System.Drawing;
# ---------- encoder_4: C# ----------
    //get the unique items from the code list
    var unique_items = new HashSet<string>(Codes);


    //create an array with the unique strings
    string [] unique_array = new string[unique_items.Count + 1];
    unique_items.CopyTo(unique_array, 1);
    Unique = unique_array;



    //encode the list of colors based on the indices in the unique array

    var encoded_list = new List<int>();
    for (int i = 0; i < Codes.Count; i++)
    {
      for (int j = 0; j < unique_array.Length; j++)
      {
        if(unique_array[j] == Codes[i])
        {
          encoded_list.Add(j);


        }

      }
    }
    Encoded = encoded_list;


    //decode the list to retrieve the color values
    var decoded_list = new List<string>();

    for (int i = 0; i < encoded_list.Count; i++)
    {
      for (int j = 0; j < unique_array.Length; j++)
      {
        if(encoded_list[i] == j)
        {
          decoded_list.Add(unique_array[j]);
        }

      }

    }
    Decoded = decoded_list;
# ---------- end encoder_4 ----------
encoded = Panel(encoder_4.Encoded)
unique = Panel(encoder_4.Unique)

# ----
custom_preview_5 = CustomPreview(Geometry=[list_item_6, tree_branch_3], Material=ColourSwatch(SwatchColor=RGBA(255, 0, 255, 132)))
geometry = Geometry()
member_index = MemberIndex(Set=encoder_3.UniqueBinaryCodes, Member=graft(encoder_3.UniqueBinaryCodes))  # -> Index, Count

# ---- group: UNIQUE INDEX LIST
encoder_5 = CSharpScript(Codes=flatten(panel_5), Chuncks=tree_item_2)  # -> out, Unique, Encoded, Decoded; inputs Codes: list of String, Chuncks: list of Mesh; same code as encoder_4
encoded_2 = Panel(encoder_5.Encoded)
unique_2 = Panel(encoder_5.Unique)

# ----
list_item_7 = ListItem(List=member_index.Index, Index=0, Wrap=True)
geometry_2 = Geometry()
list_item_8 = ListItem(List=box_array_3.Geometry, Index=list_item_7, Wrap=True)  # -> flatten(Item)
vector_xyz = VectorXYZ(XComponent=Slider(8, range=0..100), YComponent=Slider(2, range=0..100), ZComponent=Slider(8, range=0..100))  # -> Vector, Length
vector_xyz_2 = VectorXYZ(XComponent=Slider(8, range=0..10), YComponent=Slider(1, range=0..10), ZComponent=Slider(8, range=0..10))  # -> Vector, Length
member_index_2 = MemberIndex(Set=panel_3, Member=graft(encoder_4.Unique))  # -> Index, Count
list_item_9 = ListItem(List=tree_item_3, Index=list_item_7, Wrap=True)  # -> flatten(Item)
evaluate_box = EvaluateBox(Box=list_item_8, UParameter=0.5, VParameter=0.5, WParameter=0.5)  # -> Plane, Point, Include
list_item_10 = ListItem(List=member_index_2.Index, Index=0, Wrap=True)
member_index_3 = MemberIndex(Set=panel_5, Member=graft(encoder_5.Unique))  # -> Index, Count
model_synthesis = ModelSynthesis(
    InputModel=box_array_3.Geometry,
    InputValues=encoder_3.EncodedList,
    PatternSize=Slider(2, range=1..10),
    InputSize=vector_xyz.Vector,
    OutputSize=vector_xyz_2.Vector,
    Probabilistic=Toggle(True),
    Periodic=Toggle(True),
    Generate=Button())  # -> OutputModel, OutputValues, Patterns, Probabilities, Messages
vector_xyz_3 = VectorXYZ(XComponent=Slider(8, range=0..100), YComponent=Slider(2, range=0..100), ZComponent=Slider(8, range=0..100))  # -> Vector, Length
vector_xyz_4 = VectorXYZ(XComponent=Slider(8, range=0..10), YComponent=Slider(1, range=0..10), ZComponent=Slider(8, range=0..10))  # -> Vector, Length
list_item_11 = ListItem(List=box_array.Geometry, Index=list_item_10, Wrap=True)  # -> flatten(Item)
list_item_12 = ListItem(List=tree_item, Index=list_item_10, Wrap=True)  # -> flatten(Item)
list_item_13 = ListItem(List=member_index_3.Index, Index=0, Wrap=True)
evaluate_box_2 = EvaluateBox(Box=list_item_11, UParameter=0.5, VParameter=0.5, WParameter=0.5)  # -> Plane, Point, Include
vector_xyz_5 = VectorXYZ(XComponent=Slider(8, range=0..100), YComponent=Slider(3, range=0..100), ZComponent=Slider(8, range=0..100))  # -> Vector, Length
vector_xyz_6 = VectorXYZ(XComponent=Slider(6, range=0..10), YComponent=Slider(1, range=0..10), ZComponent=Slider(6, range=0..10))  # -> Vector, Length
list_item_14 = ListItem(List=box_array_2.Geometry, Index=list_item_13, Wrap=True)  # -> flatten(Item)
panel_7 = Panel(list_item_12)
area = Area(Geometry=model_synthesis.OutputModel)  # -> Area, simplify(graft(Centroid))
panel_8 = Panel(model_synthesis.OutputModel)
panel_9 = Panel(model_synthesis.OutputValues)
panel_10 = Panel(model_synthesis.Patterns)
panel_11 = Panel(model_synthesis.Probabilities)
model_synthesis_2 = ModelSynthesis(
    InputModel=box_array.Geometry,
    InputValues=encoder_4.Encoded,
    PatternSize=Slider(2, range=1..10),
    InputSize=vector_xyz_3.Vector,
    OutputSize=vector_xyz_4.Vector,
    Probabilistic=Toggle(True),
    Periodic=Toggle(True),
    Generate=Button())  # -> OutputModel, OutputValues, Patterns, Probabilities, Messages
list_item_15 = ListItem(List=tree_item_2, Index=list_item_13, Wrap=True)  # -> flatten(Item)
graft_tree_4 = GraftTree(Tree=list_item_9, IncludeEmptyLists=True, IncludeNullItems=True)
graft_tree_5 = GraftTree(Tree=evaluate_box.Point, IncludeEmptyLists=True, IncludeNullItems=True)
evaluate_box_3 = EvaluateBox(Box=list_item_14, UParameter=0.5, VParameter=0.5, WParameter=0.5)  # -> Plane, Point, Include
tree_statistics_4 = TreeStatistics(Tree=area.Centroid)  # -> Paths, Length, Count
panel_12 = Panel(list_item_15)
graft_tree_6 = GraftTree(Tree=model_synthesis.OutputValues, IncludeEmptyLists=True, IncludeNullItems=True)
model_synthesis_3 = ModelSynthesis(
    InputModel=box_array_2.Geometry,
    InputValues=encoder_5.Encoded,
    PatternSize=Slider(3, range=1..10),
    InputSize=vector_xyz_5.Vector,
    OutputSize=vector_xyz_6.Vector,
    Probabilistic=Toggle(True),
    Periodic=Toggle(True),
    Generate=Button())  # -> OutputModel, OutputValues, Patterns, Probabilities, Messages
construct_path = ConstructPath(Indices=graft_tree_6)  # -> flatten(Branch)
panel_13 = Panel(model_synthesis_2.OutputModel)
panel_14 = Panel(model_synthesis_2.OutputValues)
panel_15 = Panel(model_synthesis_2.Patterns)
panel_16 = Panel(model_synthesis_2.Probabilities)
area_2 = Area(Geometry=model_synthesis_2.OutputModel)  # -> Area, simplify(graft(Centroid))
tree_statistics_5 = TreeStatistics(Tree=graft_tree_5)  # -> Paths, Length, Count
graft_tree_7 = GraftTree(Tree=list_item_12, IncludeEmptyLists=True, IncludeNullItems=True)
graft_tree_8 = GraftTree(Tree=evaluate_box_2.Point, IncludeEmptyLists=True, IncludeNullItems=True)
replace_paths = ReplacePaths(Data=area.Centroid, Search=tree_statistics_4.Paths, Replace=construct_path)
replace_items = ReplaceItems(List="0", Indices="0", Wrap=False)  # -> simplify(flatten(List))
tree_statistics_6 = TreeStatistics(Tree=area_2.Centroid)  # -> Paths, Length, Count
graft_tree_9 = GraftTree(Tree=model_synthesis_2.OutputValues, IncludeEmptyLists=True, IncludeNullItems=True)
panel_17 = Panel(model_synthesis_3.OutputModel)
panel_18 = Panel(model_synthesis_3.OutputValues)
panel_19 = Panel(model_synthesis_3.Patterns)
panel_20 = Panel(model_synthesis_3.Probabilities)
area_3 = Area(Geometry=model_synthesis_3.OutputModel)  # -> Area, simplify(graft(Centroid))
graft_tree_10 = GraftTree(Tree=list_item_15, IncludeEmptyLists=True, IncludeNullItems=True)
graft_tree_11 = GraftTree(Tree=evaluate_box_3.Point, IncludeEmptyLists=True, IncludeNullItems=True)
construct_path_2 = ConstructPath(Indices=graft_tree_9)  # -> flatten(Branch)
merge = Merge(Data1=simplify(replace_items), Data2=simplify(replace_paths))
tree_statistics_7 = TreeStatistics(Tree=graft_tree_8)  # -> Paths, Length, Count
tree_statistics_8 = TreeStatistics(Tree=area_3.Centroid)  # -> Paths, Length, Count
graft_tree_12 = GraftTree(Tree=model_synthesis_3.OutputValues, IncludeEmptyLists=True, IncludeNullItems=True)
replace_paths_2 = ReplacePaths(Data=area_2.Centroid, Search=tree_statistics_6.Paths, Replace=construct_path_2)
tree_statistics_9 = TreeStatistics(Tree=merge)  # -> Paths, Length, Count
construct_path_3 = ConstructPath(Indices=graft_tree_12)  # -> flatten(Branch)
replace_items_2 = ReplaceItems(List="0", Indices="0", Wrap=False)  # -> simplify(flatten(List))
tree_statistics_10 = TreeStatistics(Tree=graft_tree_11)  # -> Paths, Length, Count
replace_paths_3 = ReplacePaths(Data=area_3.Centroid, Search=tree_statistics_8.Paths, Replace=construct_path_3)
merge_2 = Merge(Data1=simplify(replace_items_2), Data2=simplify(replace_paths_2))
replace_items_3 = ReplaceItems(List="0", Indices="0", Wrap=False)  # -> simplify(flatten(List))
shortest_list = ShortestList(ListListA=tree_statistics_9.Paths, ListListB=tree_statistics_5.Paths, TrimMode=2)  # -> ListListA, ListListB
tree_statistics_11 = TreeStatistics(Tree=merge_2)  # -> Paths, Length, Count
shortest_list_2 = ShortestList(ListListA=tree_statistics_11.Paths, ListListB=tree_statistics_7.Paths, TrimMode=2)  # -> ListListA, ListListB
tree_branch_4 = TreeBranch(Tree=graft_tree_7, Path=shortest_list_2.ListListB, MaintainPaths=True)
tree_branch_5 = TreeBranch(Tree=graft_tree_8, Path=shortest_list_2.ListListB, MaintainPaths=True)
orient = Orient(Geometry=simplify(tree_branch_4), Source=simplify(tree_branch_5), Target=merge_2)  # -> Geometry, Transform
merge_3 = Merge(Data1=simplify(replace_items_3), Data2=simplify(replace_paths_3))
tree_branch_6 = TreeBranch(Tree=graft_tree_4, Path=shortest_list.ListListB, MaintainPaths=True)
tree_branch_7 = TreeBranch(Tree=graft_tree_5, Path=shortest_list.ListListB, MaintainPaths=True)
custom_preview_6 = CustomPreview(Geometry=orient.Geometry, Material=ColourSwatch(SwatchColor=RGB(99, 211, 255)))
orient_2 = Orient(Geometry=simplify(tree_branch_6), Source=simplify(tree_branch_7), Target=merge)  # -> flatten(Geometry), Transform
tree_statistics_12 = TreeStatistics(Tree=merge_3)  # -> Paths, Length, Count
shortest_list_3 = ShortestList(ListListA=tree_statistics_12.Paths, ListListB=tree_statistics_10.Paths, TrimMode=2)  # -> ListListA, ListListB
tree_branch_8 = TreeBranch(Tree=graft_tree_10, Path=shortest_list_3.ListListB, MaintainPaths=True)
tree_branch_9 = TreeBranch(Tree=graft_tree_11, Path=shortest_list_3.ListListB, MaintainPaths=True)
orient_3 = Orient(Geometry=simplify(tree_branch_8), Source=simplify(tree_branch_9), Target=merge_3)  # -> Geometry, Transform
custom_preview_7 = CustomPreview(Geometry=orient_3.Geometry, Material=ColourSwatch(SwatchColor=RGB(255, 0, 255)))
geometry_3 = Geometry(orient_2.Geometry)
custom_preview_8 = CustomPreview(Geometry=geometry_3, Material=ColourSwatch(SwatchColor=RGB(255, 0, 255)))

geometry_4 = Geometry([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])
geometry_5 = Geometry([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])
encoder_6 = Encoder(InputVoxels=geometry_5, InputChuncks=geometry_4)  # -> BinaryCode, UniqueBinaryCodes, EncodedList
panel_21 = Panel(encoder_6.BinaryCode)
vector_xyz_7 = VectorXYZ(XComponent=Slider(8, range=0..100), YComponent=Slider(8, range=0..100), ZComponent=Slider(3, range=0..100))  # -> Vector, Length
vector_xyz_8 = VectorXYZ(XComponent=Slider(8, range=0..10), YComponent=Slider(9, range=0..10), ZComponent=Slider(1, range=0..10))  # -> Vector, Length
replace_items_4 = ReplaceItems(List="0", Indices="0", Wrap=False)  # -> simplify(flatten(List))

# ---- group: UNIQUE INDEX LIST
encoder_7 = CSharpScript(Codes=flatten(panel_21), Chuncks=geometry_4)  # -> out, Unique, Encoded, Decoded; inputs Codes: list of String, Chuncks: list of Mesh; same code as encoder_4
encoded_3 = Panel(encoder_7.Encoded)
unique_3 = Panel(encoder_7.Unique)

# ---- group: numbers on the input model
area_4 = Area(Geometry=geometry_5)  # -> Area, Centroid
text_tag = TextTag(Location=area_4.Centroid, Text=encoded_3, Colour=ColourSwatch(SwatchColor=RGB(255, 255, 255)))

# ----
member_index_4 = MemberIndex(Set=panel_21, Member=graft(encoder_7.Unique))  # -> Index, Count
list_item_16 = ListItem(List=member_index_4.Index, Index=0, Wrap=True)
list_item_17 = ListItem(List=geometry_5, Index=list_item_16, Wrap=True)  # -> flatten(Item)
list_item_18 = ListItem(List=geometry_4, Index=list_item_16, Wrap=True)  # -> flatten(Item)
evaluate_box_4 = EvaluateBox(Box=list_item_17, UParameter=0.5, VParameter=0.5, WParameter=0.5)  # -> Plane, Point, Include
panel_22 = Panel(list_item_18)
model_synthesis_4 = ModelSynthesis(
    InputModel=geometry_5,
    InputValues=encoder_7.Encoded,
    PatternSize=Slider(2, range=1..10),
    InputSize=vector_xyz_7.Vector,
    OutputSize=vector_xyz_8.Vector,
    Probabilistic=Toggle(True),
    Periodic=Toggle(True),
    Generate=Button())  # -> OutputModel, OutputValues, Patterns, Probabilities, Messages
graft_tree_13 = GraftTree(Tree=evaluate_box_4.Point, IncludeEmptyLists=True, IncludeNullItems=True)  # -> simplify(Tree)
graft_tree_14 = GraftTree(Tree=list_item_18, IncludeEmptyLists=True, IncludeNullItems=True)  # -> simplify(Tree)
panel_23 = Panel(model_synthesis_4.OutputValues)
panel_24 = Panel(model_synthesis_4.Patterns)
panel_25 = Panel(model_synthesis_4.Probabilities)
area_5 = Area(Geometry=model_synthesis_4.OutputModel)  # -> Area, simplify(graft(Centroid))
tree_statistics_13 = TreeStatistics(Tree=area_5.Centroid)  # -> Paths, Length, Count
graft_tree_15 = GraftTree(Tree=model_synthesis_4.OutputValues, IncludeEmptyLists=True, IncludeNullItems=True)
construct_path_4 = ConstructPath(Indices=graft_tree_15)  # -> flatten(Branch)
replace_paths_4 = ReplacePaths(Data=area_5.Centroid, Search=tree_statistics_13.Paths, Replace=construct_path_4)
merge_4 = Merge(Data1=simplify(replace_items_4), Data2=simplify(replace_paths_4))
tree_statistics_14 = TreeStatistics(Tree=merge_4)  # -> Paths, Length, Count
tree_branch_10 = TreeBranch(Tree=graft_tree_14, Path=tree_statistics_14.Paths, MaintainPaths=True)
tree_branch_11 = TreeBranch(Tree=graft_tree_13, Path=tree_statistics_14.Paths, MaintainPaths=True)
orient_4 = Orient(Geometry=simplify(tree_branch_10), Source=simplify(tree_branch_11), Target=merge_4)  # -> Geometry, Transform
panel_26 = Panel(tree_statistics_14.Paths)

area_6 = Area(Geometry=model_synthesis_4.OutputModel)  # -> Area, Centroid
unit_x = UnitX(Factor=Slider(9, range=0..100))
move = Move(Geometry=area_6.Centroid, Motion=unit_x)  # -> Geometry, Transform
text_tag_2 = TextTag(Location=move.Geometry, Text=panel_23)

# ---- group: ouput model
r = Slider(9, range=0..100)
unit_x_2 = UnitX(Factor=r)
move_2 = Move(Geometry=orient_4.Geometry, Motion=unit_x_2)  # -> Geometry, Transform
custom_preview_9 = CustomPreview(Geometry=move_2.Geometry, Material=ColourSwatch(SwatchColor=RGB(208, 83, 187)))
