# Grasshopper definition Model synthesis with encoded color list as input.gh (Grasshopper 1.0.7)
# plug-ins: Thesistheamazingtwo

surface = Surface([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])

# ---- group: Colors
L = Slider(16, range=0..100)
merge = Merge(
    Data1=ColourSwatch(SwatchColor=RGB(255, 0, 0)),
    Data2=ColourSwatch(SwatchColor=RGB(0, 0, 255)),
    Data3=ColourSwatch(SwatchColor=RGB(0, 255, 0)),
    Data4=ColourSwatch(SwatchColor=RGB(255, 255, 255)))
repeat_data = RepeatData(Data=merge, Length=L)
encoder = CSharpScript(Colors=repeat_data)  # -> out, Unique, Encoded, Decoded; inputs Colors: list of Color
# ---------- encoder: C# usings ----------
using System.Drawing;
# ---------- encoder: C# ----------
    //get the unique items from the color list
    var unique_items = new HashSet<Color>(Colors);


    //create an array with the unique colors
    Color [] unique_array = new Color[unique_items.Count + 1];
    unique_items.CopyTo(unique_array, 1);
    Unique = unique_array;

    //encode the list of colors based on the indices in the unique array
    var encoded_list = new List<int>();
    for (int i = 0; i < Colors.Count; i++)
    {
      for (int j = 0; j < unique_array.Length; j++)
      {
        if(unique_array[j] == Colors[i])
        {
          encoded_list.Add(j);
        }
      }
    }
    Encoded = encoded_list;


    //decode the list to retrieve the color values
    var decoded_list = new List<Color>();
    for (int i = 0; i < encoded_list.Count; i++)
    {
      for (int j = 0; j < unique_array.Length; j++)
      {
        if(encoded_list[i] == j)
        {
          decoded_list.Add(unique_array[j]);
        }

      }

    }
    Decoded = decoded_list;
# ---------- end encoder ----------
panel = Panel(encoder.Decoded)
panel_2 = Panel(encoder.Unique)
panel_3 = Panel(encoder.Encoded)
z = Slider(2, range=0..10)
y = Slider(5, range=0..10)
x = Slider(5, range=0..10)
d = Slider(6, range=0..10)
vector_xyz = VectorXYZ(XComponent=x, YComponent=y, ZComponent=z)  # -> Vector, Length
vector_xyz_2 = VectorXYZ(XComponent=d, YComponent=d, ZComponent=d)  # -> Vector, Length
ps = Slider(2, range=0..10)
geometry = Geometry([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])
model_synthesis = ModelSynthesis(
    InputModel=geometry,
    InputValues=encoder.Encoded,
    PatternSize=ps,
    InputSize=vector_xyz.Vector,
    OutputSize=vector_xyz_2.Vector,
    Probabilistic=Toggle(True),
    Periodic=Toggle(True),
    Generate=Button())  # -> OutputModel, OutputValues, Patterns, Probabilities
custom_preview = CustomPreview(Geometry=geometry, Material=repeat_data)
decoder = CSharpScript(Colors=repeat_data, Values=model_synthesis.OutputValues)  # -> out, Decoded; inputs Colors: list of Color, Values: list of Int32
# ---------- decoder: C# ----------
    //get the unique items from the color list
    var unique_items = new HashSet<Color>(Colors);


    //create an array with the unique colors
    Color [] unique_array = new Color[unique_items.Count+1];
    unique_items.CopyTo(unique_array,1);





    //decode the list to retrieve the color values
    var decoded_list = new List<Color>();
    for (int i = 0; i < Values.Count; i++)
    {
      for (int j = 0; j < unique_array.Length; j++)
      {
        if(Values[i] == j)
        {
          decoded_list.Add(unique_array[j]);
        }

      }

    }
    Decoded = decoded_list;
# ---------- end decoder ----------
panel_4 = Panel(model_synthesis.OutputValues)
panel_5 = Panel(model_synthesis.Patterns)
panel_6 = Panel(model_synthesis.Probabilities)
custom_preview_2 = CustomPreview(Geometry=model_synthesis.OutputModel, Material=decoder.Decoded)

# ----
surface_2 = Surface([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])
encoder_2 = CSharpScript(Surf=surface_2)  # -> out, Encoded; inputs Surf: list of Surface
# ---------- encoder_2: C# ----------
    //encode the list of colors based on the indices in the unique array
    var encoded_list = new List<int>();
    for (int i = 1; i < Surf.Count + 1; i++)
    {

      encoded_list.Add(i);


    }
    Encoded = encoded_list;
# ---------- end encoder_2 ----------
panel_7 = Panel(encoder_2.out)
panel_8 = Panel(encoder_2.Encoded)

encoder_3 = CSharpScript(Surf=surface)  # -> out, Unique, Encoded; inputs Surf: list of Surface
# ---------- encoder_3: C# ----------
    //encode the list of colors based on the indices in the unique array
    var encoded_list = new List<int>();
    for (int i = 1; i < Surf.Count+1; i++)
    {

      encoded_list.Add(i);


    }
    Encoded = encoded_list;
# ---------- end encoder_3 ----------
custom_preview_3 = CustomPreview(Geometry=surface, Material=ColourSwatch(SwatchColor=RGB(255, 79, 170)))
panel_9 = Panel(encoder_3.out)
panel_10 = Panel(encoder_3.Encoded)
x_2 = Slider(6, range=0..10)
y_2 = Slider(3, range=0..10)
z_2 = Slider(2, range=0..10)
x_3 = Slider(6, range=0..10)
y_3 = Slider(3, range=0..10)
z_3 = Slider(2, range=0..10)

# ---- group: Surface
geometry_2 = Geometry([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])
vector_xyz_3 = VectorXYZ(XComponent=Slider(12, range=0..100), YComponent=Slider(12, range=0..100), ZComponent=Slider(3, range=0..10))  # -> Vector, Length
vector_xyz_4 = VectorXYZ(XComponent=Slider(12, range=0..100), YComponent=Slider(12, range=0..100), ZComponent=Slider(3, range=0..10))  # -> Vector, Length
ps_2 = Slider(1, range=0..10)
model_synthesis_2 = ModelSynthesis(
    InputModel=geometry_2,
    InputValues=panel_8,
    PatternSize=ps_2,
    InputSize=vector_xyz_3.Vector,
    OutputSize=vector_xyz_4.Vector,
    Probabilistic=Toggle(False),
    Periodic=Toggle(True),
    Generate=Button())  # -> OutputModel, OutputValues, Patterns, Probabilities
panel_11 = Panel(model_synthesis_2.Probabilities)
panel_12 = Panel(model_synthesis_2.Patterns)
geometry_3 = Geometry(model_synthesis_2.OutputModel)
panel_13 = Panel(model_synthesis_2.OutputValues)

# ----
vector_xyz_5 = VectorXYZ(XComponent=x_2, YComponent=y_2, ZComponent=z_2)  # -> Vector, Length
vector_xyz_6 = VectorXYZ(XComponent=x_3, YComponent=y_3, ZComponent=z_3)  # -> Vector, Length
ps_3 = Slider(1, range=0..10)
geometry_4 = Geometry([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])
model_synthesis_3 = ModelSynthesis(
    InputModel=geometry_4,
    InputValues=panel_10,
    PatternSize=ps_3,
    InputSize=vector_xyz_5.Vector,
    OutputSize=vector_xyz_6.Vector,
    Probabilistic=Toggle(True),
    Periodic=Toggle(True),
    Generate=Button())  # -> OutputModel, OutputValues, Patterns, Probabilities
custom_preview_4 = CustomPreview(Geometry=geometry_4, Material=ColourSwatch(SwatchColor=RGBA(194, 194, 194, 39)))
geometry_5 = Geometry(model_synthesis_3.OutputModel)
panel_14 = Panel(model_synthesis_3.Probabilities)
panel_15 = Panel(model_synthesis_3.Patterns)
panel_16 = Panel(model_synthesis_3.OutputValues)

# ---- group: must cast as Mesh
mesh = Mesh(surface)

mesh_2 = Mesh(surface_2)

# ----
decoder_2 = CSharpScript(Surf=mesh, Values=model_synthesis_3.OutputValues)  # -> out, Decoded; inputs Surf: list of Mesh, Values: list of Int32
# ---------- decoder_2: C# ----------
    //decode the list to retrieve the color values
    var decoded_list = new List<Mesh>();
    for (int i = 0; i < Values.Count; i++)
    {
      for (int j = 0; j < Surf.Count + 1; j++)
      {
        if(Values[i] == (j + 1))
        {
          decoded_list.Add(Surf[j]);
        }

      }

    }
    Decoded = decoded_list;
# ---------- end decoder_2 ----------

decoder_3 = CSharpScript(Surf=mesh_2, Values=model_synthesis_2.OutputValues)  # -> out, Decoded; inputs Surf: list of Mesh, Values: list of Int32; same code as decoder_2
geometry_6 = Geometry(decoder_3.Decoded)
custom_preview_5 = CustomPreview(Geometry=geometry_6, Material=ColourSwatch(SwatchColor=RGB(255, 122, 255)))

geometry_7 = Geometry(decoder_2.Decoded)
custom_preview_6 = CustomPreview(Geometry=geometry_7, Material=ColourSwatch(SwatchColor=RGB(224, 130, 224)))
