# Grasshopper definition Model_Synthesis with voxel inputs sphere box etc.gh (Grasshopper 1.0.7)
# plug-ins: Thesistheamazingtwo

# ---- group: Pattern box
number_slider = Slider(5, range=0..10)
colour_swatch = ColourSwatch(SwatchColor=RGB(0, 144, 255))
number_slider_2 = Slider(5, range=0..10)
colour_swatch_2 = ColourSwatch(SwatchColor=RGB(255, 163, 208))
colour_swatch_3 = ColourSwatch(SwatchColor=RGB(158, 213, 255))
colour_swatch_4 = ColourSwatch(SwatchColor=RGB(255, 123, 0))
geometry = Geometry([<brep referenced from the Rhino model> x180])
box = Box(flatten([{Plane=PlaneXY(0, 0, 0), X=Domain(0, 1), Y=Domain(0, 1), Z=Domain(0, 1)}, {Plane=PlaneXY(0, 0, 0), X=Domain(0, 1), Y=Domain(0, 1), Z=Domain(1, 2)}, {Plane=PlaneXY(0, 0, 0), X=Domain(0, 1), Y=Domain(0, 1), Z=Domain(2, 3)}, {Plane=PlaneXY(0, 0, 0), X=Domain(0, 1), Y=Domain(0, 1), Z=Domain(3, 4)}, {Plane=PlaneXY(0, 0, 0), X=Domain(0, 1), Y=Domain(0, 1), Z=Domain(4, 5)}, {Plane=PlaneXY(0, 0, 0), X=Domain(0, 1), Y=Domain(1, 2), Z=Domain(0, 1)}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]))
repeat_data = RepeatData(Data=colour_swatch_2, Length=number_slider_2)
repeat_data_2 = RepeatData(Data=colour_swatch_3, Length=number_slider_2)
repeat_data_3 = RepeatData(Data=colour_swatch_2, Length=number_slider)
repeat_data_4 = RepeatData(Data=colour_swatch_3, Length=number_slider)
merge = Merge(Data1=repeat_data_2, Data2=repeat_data)
merge_2 = Merge(Data1=repeat_data_3, Data2=repeat_data_4)
repeat_data_5 = RepeatData(Data=merge, Length=Slider(90, range=0..1000))
repeat_data_6 = RepeatData(Data=merge_2, Length=Slider(90, range=0..1000))
merge_3 = Merge(Data1=repeat_data_5, Data2=repeat_data_6)  # -> flatten(Result)
custom_preview = CustomPreview(Geometry=box, Material=merge_3)

# ---- group: Sphere Input
xyz = Slider(0.5, range=0..1)
number_slider_3 = Slider(10, range=0..10)
construct_point = ConstructPoint(XCoordinate=0, YCoordinate=0, ZCoordinate=0)
division = Division(A=number_slider_3, B=2)
center_box = CenterBox(Base=PlaneXY(0, 0, 0), X=xyz, Y=xyz, Z=xyz)
R = Slider(3.22, range=0..10)
construct_point_2 = ConstructPoint(XCoordinate=division, YCoordinate=division, ZCoordinate=division)
box_array = BoxArray(Geometry=construct_point, Cell=center_box, XCount=number_slider_3, YCount=number_slider_3, ZCount=number_slider_3)  # -> Geometry, Transform
sphere = Sphere(Base=construct_point_2, Radius=R)
xyz_2 = Slider(0.5, range=0..1)
point_in_brep = PointInBrep(Brep=sphere, Point=box_array.Geometry, Strict=False)
cull_pattern = CullPattern(List=box_array.Geometry, CullPattern=point_in_brep)
center_box_2 = CenterBox(Base=cull_pattern, X=xyz_2, Y=xyz_2, Z=xyz_2)

# ---- group: 50/50 colors
b = Slider(2, range=0..10)
list_length = ListLength(List=center_box_2)
division_2 = Division(A=list_length, B=b)
split_list = SplitList(List=center_box_2, Index=division_2)  # -> ListA, ListB
list_length_2 = ListLength(List=split_list.ListB)
list_length_3 = ListLength(List=split_list.ListA)
repeat_data_7 = RepeatData(Data=ColourSwatch(SwatchColor=RGB(255, 0, 0)), Length=list_length_2)
repeat_data_8 = RepeatData(Data=ColourSwatch(SwatchColor=RGB(191, 255, 143)), Length=list_length_3)
merge_4 = Merge(Data1=repeat_data_8, Data2=repeat_data_7)
custom_preview_2 = CustomPreview(Geometry=center_box_2, Material=merge_4)

# ---- group: random colors input
geometry_2 = Geometry([<brep referenced from the Rhino model> x86])
s = Slider(255, range=0..255)
box_2 = Box(geometry_2)
list_length_4 = ListLength(List=box_2)
random = Random(Range=s, Number=list_length_4, Seed=2)
jitter = Jitter(List=random, Jitter=1, Seed=2)  # -> Values, Indices
jitter_2 = Jitter(List=random, Jitter=1, Seed=2)  # -> Values, Indices
colour_rgb = ColourRGB(Alpha=255, Red=random, Green=jitter.Values, Blue=jitter_2.Values)
repeat_data_9 = RepeatData(Data=colour_rgb, Length=list_length_4)
custom_preview_3 = CustomPreview(Geometry=box_2, Material=colour_rgb)

# ----
colour = Colour(merge_4)

number_slider_4 = Slider(6, range=0..100)
xyz_3 = Slider(10, range=0..10)
y = Slider(10, range=0..10)
z = Slider(10, range=0..10)
x = Slider(10, range=0..10)
vector_xyz = VectorXYZ(XComponent=x, YComponent=y, ZComponent=z)  # -> Vector, Length
vector_xyz_2 = VectorXYZ(XComponent=number_slider_4, YComponent=number_slider_4, ZComponent=number_slider_4)  # -> Vector, Length
ps = Slider(4, range=0..10)
geometry_3 = Geometry()
colour_2 = Colour()
model_synthesiscolors = ModelSynthesisColors(
    InputModel=geometry_3,
    InputColors=colour_2,
    PatternSize=ps,
    InputSize=vector_xyz.Vector,
    OutputSize=vector_xyz_2.Vector,
    Probabilistic=Toggle(True),
    Periodic=Toggle(True),
    Generate=Button())  # -> OutputModel, OutputColors, Patterns, Probabilities
custom_preview_4 = CustomPreview(Geometry=model_synthesiscolors.OutputModel, Material=model_synthesiscolors.OutputColors)
panel = Panel(model_synthesiscolors.Probabilities)
colour_3 = Colour(model_synthesiscolors.OutputColors)
panel_2 = Panel(model_synthesiscolors.Patterns)
panel_3 = Panel(colour_3)
