# Grasshopper definition Model_Synthesis2.gh (Grasshopper 1.0.7)
# plug-ins: Thesistheamazingtwo

L = Slider(16, range=0..100)
merge = Merge(
    Data1=ColourSwatch(SwatchColor=RGB(255, 0, 0)),
    Data2=ColourSwatch(SwatchColor=RGB(0, 0, 255)),
    Data3=ColourSwatch(SwatchColor=RGB(0, 255, 0)),
    Data4=ColourSwatch(SwatchColor=RGB(255, 255, 255)))
repeat_data = RepeatData(Data=merge, Length=L)
encoder = CSharpScript(Colors=repeat_data)  # -> out, Unique, Encoded, Decoded; inputs Colors: list of Color
# ---------- encoder: C# usings ----------
using System.Drawing;
# ---------- encoder: C# ----------
    //get the unique items from the color list
    var unique_items = new HashSet<Color>(Colors);


    //create an array with the unique colors
    Color [] unique_array = new Color[unique_items.Count + 1];
    unique_items.CopyTo(unique_array, 1);
    Unique = unique_array;

    //encode the list of colors based on the indices in the unique array
    var encoded_list = new List<int>();
    for (int i = 0; i < Colors.Count; i++)
    {
      for (int j = 0; j < unique_array.Length; j++)
      {
        if(unique_array[j] == Colors[i])
        {
          encoded_list.Add(j);
        }
      }
    }
    Encoded = encoded_list;


    //decode the list to retrieve the color values
    var decoded_list = new List<Color>();
    for (int i = 0; i < encoded_list.Count; i++)
    {
      for (int j = 0; j < unique_array.Length; j++)
      {
        if(encoded_list[i] == j)
        {
          decoded_list.Add(unique_array[j]);
        }

      }

    }
    Decoded = decoded_list;
# ---------- end encoder ----------
panel = Panel(encoder.Unique)
panel_2 = Panel(encoder.out)
panel_3 = Panel(encoder.Decoded)
number_slider = Slider(6, range=0..10)
x = Slider(5, range=0..10)
y = Slider(5, range=0..10)
z = Slider(2, range=0..10)
panel_4 = Panel(encoder.Encoded)
geometry = Geometry([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])
custom_preview = CustomPreview(Geometry=geometry, Material=repeat_data)
vector_xyz = VectorXYZ(XComponent=x, YComponent=y, ZComponent=z)  # -> Vector, Length
vector_xyz_2 = VectorXYZ(XComponent=number_slider, YComponent=number_slider, ZComponent=number_slider)  # -> Vector, Length
ps = Slider(2, range=0..10)
model_synthesis = ModelSynthesis(
    InputModel=geometry,
    InputValues=encoder.Encoded,
    PatternSize=ps,
    InputSize=vector_xyz.Vector,
    OutputSize=vector_xyz_2.Vector,
    Probabilistic=Toggle(True),
    Periodic=Toggle(True),
    Generate=Button())  # -> OutputModel, OutputValues, Patterns, Probabilities
panel_5 = Panel(model_synthesis.Probabilities)
panel_6 = Panel(model_synthesis.Patterns)
panel_7 = Panel(model_synthesis.OutputValues)
decoder = CSharpScript(Colors=repeat_data, Values=model_synthesis.OutputValues)  # -> out, Decoded; inputs Colors: list of Color, Values: list of Int32
# ---------- decoder: C# ----------
    //get the unique items from the color list
    var unique_items = new HashSet<Color>(Colors);


    //create an array with the unique colors
    Color [] unique_array = new Color[unique_items.Count+1];
    unique_items.CopyTo(unique_array,1);





    //decode the list to retrieve the color values
    var decoded_list = new List<Color>();
    for (int i = 0; i < Values.Count; i++)
    {
      for (int j = 0; j < unique_array.Length; j++)
      {
        if(Values[i] == j)
        {
          decoded_list.Add(unique_array[j]);
        }

      }

    }
    Decoded = decoded_list;
# ---------- end decoder ----------
custom_preview_2 = CustomPreview(Geometry=model_synthesis.OutputModel, Material=decoder.Decoded)
