# Grasshopper definition Surface first success with periodic input.gh (Grasshopper 1.0.7)
# plug-ins: Thesistheamazingtwo

# ---- group: encoding
# the input surface
#  is periodic
brep = Brep([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])
brep_2 = Brep([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])
encoder = Encoder(InputVoxels=brep_2, InputChuncks=brep)
ghpython_script = GhPythonScript(x=encoder)  # -> out, a
# ---------- ghpython_script: Python ----------
__author__ = "Eleni"
__version__ = "2020.06.24"

import rhinoscriptsyntax as rs

a = hex(int(x, 2))
# ---------- end ghpython_script ----------
panel = Panel(ghpython_script.a)
encoder_2 = CSharpScript(Colors=flatten(panel))  # -> out, Unique, Encoded, Decoded; inputs Colors: list of String
# ---------- encoder_2: C# usings ----------
using System.Drawing;
# ---------- encoder_2: C# ----------
    //get the unique items from the color list
    var unique_items = new HashSet<string>(Colors);


    //create an array with the unique colors
    string [] unique_array = new string[unique_items.Count + 1];
    unique_items.CopyTo(unique_array, 1);
    Unique = unique_array;

    //encode the list of colors based on the indices in the unique array
    var encoded_list = new List<int>();
    for (int i = 0; i < Colors.Count; i++)
    {
      for (int j = 0; j < unique_array.Length; j++)
      {
        if(unique_array[j] == Colors[i])
        {
          encoded_list.Add(j);
          Print(Colors.Count.ToString());
        }
      }
    }
    Encoded = encoded_list;


    //decode the list to retrieve the color values
    var decoded_list = new List<string>();
    Print(encoded_list.Count.ToString());
    for (int i = 0; i < encoded_list.Count; i++)
    {
      for (int j = 0; j < unique_array.Length; j++)
      {
        if(encoded_list[i] == j)
        {
          decoded_list.Add(unique_array[j]);
        }

      }

    }
    Decoded = decoded_list;
# ---------- end encoder_2 ----------
unique = Panel(encoder_2.Unique)
area = Area(Geometry=brep_2)  # -> Area, Centroid
encoded = Panel(encoder_2.Encoded)

# ---- group: model synthesis
x = Slider(6, range=0..100)
z = Slider(2, range=0..10)
z_2 = Slider(1, range=0..10)
y = Slider(6, range=0..10)
x_2 = Slider(3, range=0..10)
y_2 = Slider(3, range=0..10)
vector_xyz = VectorXYZ(XComponent=x_2, YComponent=y_2, ZComponent=z_2)  # -> Vector, Length
vector_xyz_2 = VectorXYZ(XComponent=x, YComponent=y, ZComponent=z)  # -> Vector, Length
ps = Slider(2, range=0..10)
model_synthesis = ModelSynthesis(
    InputModel=brep_2,
    InputValues=encoder_2.Encoded,
    PatternSize=ps,
    InputSize=vector_xyz_2.Vector,
    OutputSize=vector_xyz.Vector,
    Probabilistic=Toggle(True),
    Periodic=Toggle(True),
    Generate=Button())  # -> OutputModel, OutputValues, Patterns, Probabilities
panel_2 = Panel(model_synthesis.Probabilities)
panel_3 = Panel(model_synthesis.Patterns)
panel_4 = Panel(model_synthesis.OutputValues)

# ---- group: moving things properly
area_2 = Area(Geometry=model_synthesis.OutputModel)  # -> Area, Centroid
list_item = ListItem(List=area.Centroid, Index=panel_4, Wrap=True)
list_item_2 = ListItem(List=brep, Index=panel_4, Wrap=True)
vector_2pt = Vector2Pt(PointA=list_item, PointB=area_2.Centroid, Unitize=False)  # -> Vector, Length
vector_display = VectorDisplay(Vector=vector_2pt.Vector)
move = Move(Geometry=list_item_2, Motion=vector_2pt.Vector)  # -> Geometry, Transform
custom_preview = CustomPreview(Geometry=move.Geometry, Material=ColourSwatch(SwatchColor=RGBA(255, 13, 166, 188)))
