# Grasshopper definition TRY FIX BUG 17_7.gh (Grasshopper 1.0.7)
# plug-ins: MeshEdit Components, Thesistheamazingtwo, Human

number_slider = Slider(4, range=0..10)

# ---- group: GEOMETRIES
geometry = Geometry([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])

# ---- group: VOXELS
geometry_2 = Geometry([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])

# ----
area = Area(Geometry=geometry_2)  # -> Area, Centroid
encoder = Encoder(InputVoxels=geometry_2, InputChuncks=geometry)  # -> BinaryCodes, UniqueBinaryCodes, EncodedList
bounds = Bounds(Numbers=encoder.EncodedList)
deconstruct_domain = DeconstructDomain(Domain=bounds)  # -> Start, End
gradient = Gradient(
    LowerLimit=deconstruct_domain.Start,
    UpperLimit=deconstruct_domain.End,
    Parameter=encoder.EncodedList,
    stops=[0: RGB(243, 57, 0), 0.1: RGB(236, 27, 60), 0.2: RGB(210, 0, 118), 0.3: RGB(103, 0, 120), 0.4: RGB(39, 72, 161), 0.5: RGB(1, 192, 229), 0.6: RGB(18, 178, 90), 0.7: RGB(79, 186, 8), 0.8: RGB(220, 237, 32), 0.9: RGB(247, 159, 20), 1: RGB(243, 57, 0)])
z_count = ZCount(1)
text_tag = TextTag(Location=area.Centroid, Text=encoder.EncodedList, Colour=ColourSwatch(SwatchColor=RGB(255, 255, 255)))
panel = Panel(encoder.BinaryCodes)
panel_2 = Panel(encoder.UniqueBinaryCodes)
custom_preview = CustomPreview(Geometry=geometry, Material=gradient)
number_slider_2 = Slider(16, range=0..100)
number_slider_3 = Slider(12, range=0..100)
panel_3 = Panel(encoder.EncodedList)
number_slider_4 = Slider(2, range=0..100)
number_slider_5 = Slider(6, range=0..10)
number_slider_6 = Slider(6, range=0..10)
number_slider_7 = Slider(4, range=1..10)
division = Division(A=number_slider_2, B=number_slider_7)
division_2 = Division(A=number_slider_3, B=number_slider_7)
domain_box = DomainBox(Base=PlaneXY(0, 0, 0), X=number_slider_7, Y=number_slider_7, Z=Domain(0, 0.25))
box_array = BoxArray(Geometry=domain_box, Cell=domain_box, XCount=division, YCount=division_2, ZCount=z_count)  # -> Geometry, Transform
deconstruct_brep = DeconstructBrep(Brep=box_array.Geometry)  # -> Faces, Edges, Vertices
list_item = ListItem(List=deconstruct_brep.Faces, Index=0, Wrap=True)  # -> Item, Item1, Item2, Item3, Item4
brep_edges = BrepEdges(Brep=box_array.Geometry)  # -> Naked, Interior, NonManifold
surface = Surface(reparameterize(list_item.Item4))
divide_domain² = DivideDomain²(Domain=surface, UCount=number_slider_7, VCount=number_slider_7)
isotrim = Isotrim(Surface=surface, Domain=divide_domain²)
custom_preview_lineweights = CustomPreviewLineweights(
    Geometry=brep_edges.Interior,
    Shader=ColourSwatch(SwatchColor=RGB(0, 0, 0)),
    Thickness=Slider(5.36, range=0..10),
    Absolute=False)
area_2 = Area(Geometry=isotrim)  # -> Area, Centroid
number_slider_8 = Slider(5, range=0..10)
number_slider_9 = Slider(4, range=0..10)
vector_xyz = VectorXYZ(XComponent=number_slider_2, YComponent=number_slider_3, ZComponent=number_slider_7)  # -> Vector, Length
vector_xyz_2 = VectorXYZ(XComponent=number_slider_5, YComponent=number_slider_6, ZComponent=Slider(1, range=0..10))  # -> Vector, Length
timer = Timer(TimerInterval=500, Target=model_synthesis2)  # disabled
box_array_2 = BoxArray(Geometry=domain_box, Cell=domain_box, XCount=number_slider_5, YCount=number_slider_6, ZCount=z_count)  # -> Geometry, Transform
number = Number(number_slider_7)
model_synthesis2 = ModelSynthesis2(
    InputModel=geometry_2,
    InputValues=encoder.EncodedList,
    PatternSize=number_slider_7,
    InputSize=vector_xyz.Vector,
    OutputSize=vector_xyz_2.Vector,
    Probabilistic=Toggle(True),
    Periodic=Toggle(True),
    RESET=Button())  # -> OutputModel, OutputValues, Patterns, Probabilities, PossibilitiesCount, UniquePatters
division_3 = Division(A="1", B=2)
series = Series(Start=0, Step=number, Count=number)
series_2 = Series(Start=0, Step=1, Count=number)  # -> graft(Series)
negative = Negative(Value=division_3)
brep_edges_2 = BrepEdges(Brep=box_array_2.Geometry)  # -> Naked, Interior, NonManifold
text_split = TextSplit(Text=model_synthesis2.UniquePatters, Separators=",")
text_tag_2 = TextTag(Location=area_2.Centroid, Text=text_split)
addition = Addition(A=series, B=series_2)  # -> flatten(Result)
panel_4 = Panel(model_synthesis2.OutputValues)
vector_xyz_3 = VectorXYZ(XComponent=negative, YComponent=negative, ZComponent=0)  # -> Vector, Length
panel_5 = Panel(model_synthesis2.Patterns)
panel_6 = Panel(model_synthesis2.Probabilities)
# info: Sometimes not all the tiles exist in the output model.This component gives the values that correspond to the unique elements that exist in the output model.It also gives the equivalent voxel ad the equavalent mesh.The 3 list given must have the same number of elements.
collection = Collection(
    OutputValues=model_synthesis2.OutputValues,
    EncodedList=encoder.EncodedList,
    InputVoxels=geometry_2,
    InputChuncks=geometry)  # -> OutputUnique, MeshesFound, VoxelsFound
# info: This component gives all the tiles we will need to fill the output model.If number 3 exist in our output 5 times we will get the equivalent mesh and voxel also 5 times and in the corrent index.
decoder = Decoder(
    OutputModel=model_synthesis2.OutputModel,
    OutputValues=model_synthesis2.OutputValues,
    OutputUnique=collection.OutputUnique,
    MeshesCollection=collection.MeshesFound,
    VoxelsCollection=collection.VoxelsFound)  # -> OutputGeometries, VoxelsCenters
graft_tree = GraftTree(Tree=model_synthesis2.PossibilitiesCount, IncludeEmptyLists=True, IncludeNullItems=True)
graft_tree_2 = GraftTree(Tree=model_synthesis2.Probabilities, IncludeEmptyLists=True, IncludeNullItems=True)
unit_z = UnitZ(Factor=Slider(2, range=0..10))
colour_swatch = ColourSwatch(SwatchColor=RGB(0, 0, 0))
area_3 = Area(Geometry=model_synthesis2.OutputModel)  # -> Area, Centroid
text_split_2 = TextSplit(Text=graft_tree_2, Separators=";")
equality = Equality(FirstNumber=graft_tree, SecondNumber="1")  # -> Equality, Inequality
# info: Our geometry is all the tiles that exist in the output model.Our source is the center of their boundary voxels in the input model, our target is the center of their boundary voxels in the output model.
orient = Orient(Geometry=decoder.OutputGeometries, Source=decoder.VoxelsCenters, Target=area_3.Centroid)  # -> Geometry, Transform
gradient_2 = Gradient(
    LowerLimit=deconstruct_domain.Start,
    UpperLimit=deconstruct_domain.End,
    Parameter=model_synthesis2.OutputValues,
    stops=[0: RGB(243, 57, 0), 0.1: RGB(236, 27, 60), 0.2: RGB(210, 0, 118), 0.3: RGB(103, 0, 120), 0.4: RGB(39, 72, 161), 0.5: RGB(1, 192, 229), 0.6: RGB(18, 178, 90), 0.7: RGB(79, 186, 8), 0.8: RGB(220, 237, 32), 0.9: RGB(247, 159, 20), 1: RGB(243, 57, 0)])
list_item_2 = ListItem(List=text_split_2, Index=0, Wrap=True)  # -> Item, Item1
r = Slider(22, range=0..100)
concatenate = Concatenate(Fragment_A=list_item_2.Item, Fragment_B=list_item_2.Item1)
text_split_3 = TextSplit(Text=list_item_2.Item1, Separators=",")
unit_x = UnitX(Factor=expr("x*2.4", r))
unit_x_2 = UnitX(Factor=r)
move = Move(Geometry=brep_edges_2.Interior, Motion=unit_x_2)  # -> Geometry, Transform
move_2 = Move(Geometry=move.Geometry, Motion=vector_xyz_3.Vector)  # -> Geometry, Transform
custom_preview_lineweights_2 = CustomPreviewLineweights(
    Geometry=move_2.Geometry,
    Shader=ColourSwatch(SwatchColor=RGB(0, 0, 0)),
    Thickness=Slider(5.36, range=0..10),
    Absolute=False)

evaluate_box = EvaluateBox(Box=box_array_2.Geometry, UParameter=0.5, VParameter=0.5, WParameter=0.5)  # -> Plane, Point, Include
list_item_3 = ListItem(List=move.Transform, Index=0, Wrap=True)
list_item_4 = ListItem(List=move_2.Transform, Index=0, Wrap=True)
compound = Compound(Transforms=[list_item_3, list_item_4])
transform = Transform(Geometry=graft(evaluate_box.Point), Transform=compound)

xz_plane = XZPlane(Origin=transform)
move_3 = Move(Geometry=xz_plane, Motion=unit_z)  # -> Geometry, Transform
circle = Circle(Plane=move_3.Geometry, Radius=1)
surface_2 = Surface(circle)
data = Data([ColourSwatch(SwatchColor=RGB(255, 255, 255)), ColourSwatch(SwatchColor=RGBA(55, 217, 52, 147))])
integer = Integer(text_split_3)
list_item_5 = ListItem(List=data, Index=equality.Equality, Wrap=True)
move_4 = Move(Geometry=orient.Geometry, Motion=unit_x)  # -> Geometry, Transform
colour_swatch_2 = ColourSwatch(SwatchColor=RGB(204, 75, 188))
list_item_6 = ListItem(List=integer, Index=0, Wrap=True)
text_tag_3d = TextTag3D(Location=move_3.Geometry, Text=graft_tree, Size=1, Colour=colour_swatch, Justification=5)
text_tag_3d_2 = TextTag3D(Location=move_3.Geometry, Text=concatenate, Size=0.5, Colour=colour_swatch, Justification=8)
custom_preview_2 = CustomPreview(Geometry=surface_2, Material=list_item_5)
mesh_area = MeshArea(Mesh=move_4.Geometry)  # -> Area, Centroid
custom_preview_3 = CustomPreview(Geometry=move_4.Geometry, Material=gradient_2)
text_tag_3 = TextTag(Location=mesh_area.Centroid, Text=model_synthesis2.OutputValues, Colour=ColourSwatch(SwatchColor=RGB(255, 255, 255)))

curve = Curve(surface)
point = Point(area.Centroid)
data_2 = Data(encoder.EncodedList)
data_3 = Data(geometry)
project = Project(Geometry=point, Plane=PlaneXY(0, 0, 0))  # -> Geometry, Transform
project_2 = Project(Geometry=curve, Plane=PlaneXY(0, 0, 0))  # -> Geometry, Transform
point_in_curve = PointInCurve(Point=project.Geometry, Curve=project_2.Geometry)  # -> Relationship, Point
equality_2 = Equality(FirstNumber=point_in_curve.Relationship, SecondNumber=2)  # -> Equality, Inequality
cull_pattern = CullPattern(List=project.Geometry, CullPattern=equality_2.Equality)
cull_pattern_2 = CullPattern(List=data_2, CullPattern=equality_2.Equality)
average = Average(Input=cull_pattern)  # -> flatten(ArithmeticMean)
sort_list = SortList(Keys=cull_pattern_2)  # -> Keys, ValuesA
sort_list_2 = SortList(Keys=text_split)  # -> Keys, ValuesValuesA
text_join = TextJoin(Text=text_split)

mesh_brep = MeshBrep(
    Brep=data_3,
    Settings={GridMaxCount=0, GridMinCount=16, JaggedSeams=False, MaxEdgeLength=0, MinEdgeLength=0.0001, MinTolerance=0, Refine=True, RefineAngle=0, RelativeTolerance=0.65, SimplePlanes=True, Tolerance=0})
mesh_colours = MeshColours(Mesh=graft(mesh_brep), Colours=graft(gradient))  # -> flatten(Mesh)
list_item_7 = ListItem(List=cull_pattern_2, Index=addition, Wrap=True)

cull_pattern_3 = CullPattern(List=mesh_colours, CullPattern=equality_2.Equality)
group = Group(Objects=cull_pattern_3)  # -> flatten(Group)
text_join_2 = TextJoin(Text=list_item_7)  # -> flatten(Result)
member_index = MemberIndex(Set=text_join_2, Member=text_join)  # -> Index, Count
list_item_8 = ListItem(List=member_index.Index, Index=0, Wrap=True)
list_item_9 = ListItem(List=average, Index=list_item_8, Wrap=True)  # -> flatten(Item)
list_item_10 = ListItem(List=group, Index=list_item_8, Wrap=True)  # -> flatten(Item)

list_length = ListLength(List=list_item_9)
series_3 = Series(Start=0, Step=1, Count=list_length)
text_tag_3d_3 = TextTag3D(Location=list_item_9, Text=series_3, Size=1, Justification=5)
list_item_11 = ListItem(List=list_item_10, Index=list_item_6, Wrap=True)
list_item_12 = ListItem(List=list_item_9, Index=list_item_6, Wrap=True)
orient_2 = Orient(Geometry=list_item_11, Source=list_item_12, Target=transform)  # -> Geometry, Transform
