# Grasshopper definition Voxel_0.gh (Grasshopper 1.0.7)
# plug-ins: Human

# ---- group: surf chunk
brep = Brep(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)

# ---- group: box
brep_2 = Brep(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)

# ----
# Get the faces of the voxel and all the edges of the chunck
# for every face
#   for every edge
#       check intersection
#       if intersects
#       associate the edge with the       face
#       divide the face into points
number_slider = Slider(0, range=0..100)
deconstruct_brep = DeconstructBrep(Brep=brep_2)  # -> Faces, Edges, Vertices
deconstruct_brep_2 = DeconstructBrep(Brep=brep)  # -> Faces, Edges, Vertices
list_item = ListItem(List=deconstruct_brep.Faces, Index=number_slider, Wrap=True)  # -> Item, Item1, Item2, Item3, Item4, Item5
surface_curve = SurfaceCurve(Surface=list_item.Item, Curve=deconstruct_brep_2.Edges)  # -> flatten(Curves), Points, UVPoints, Normals, Parameters, Tangents
surface_curve_2 = SurfaceCurve(Surface=list_item.Item1, Curve=deconstruct_brep_2.Edges)  # -> flatten(Curves), Points, UVPoints, Normals, Parameters, Tangents
surface_curve_3 = SurfaceCurve(Surface=list_item.Item2, Curve=deconstruct_brep_2.Edges)  # -> flatten(Curves), Points, UVPoints, Normals, Parameters, Tangents
surface_curve_4 = SurfaceCurve(Surface=list_item.Item3, Curve=deconstruct_brep_2.Edges)  # -> flatten(Curves), Points, UVPoints, Normals, Parameters, Tangents
surface_curve_5 = SurfaceCurve(Surface=list_item.Item4, Curve=deconstruct_brep_2.Edges)  # -> flatten(Curves), Points, UVPoints, Normals, Parameters, Tangents
surface_curve_6 = SurfaceCurve(Surface=list_item.Item5, Curve=deconstruct_brep_2.Edges)  # -> flatten(Curves), Points, UVPoints, Normals, Parameters, Tangents
panel = Panel(surface_curve_5.Curves)
panel_2 = Panel(surface_curve_6.Curves)
custom_preview_lineweights = CustomPreviewLineweights(
    Geometry=[surface_curve.Curves, surface_curve_2.Curves, surface_curve_3.Curves, surface_curve_4.Curves],
    Shader=ColourSwatch(SwatchColor=RGB(255, 255, 255)),
    Thickness=Slider(10, range=0..10),
    Absolute=False)
area = Area(Geometry=deconstruct_brep.Faces)  # -> Area, Centroid
divide_curve = DivideCurve(
    Curve=[surface_curve.Curves, surface_curve_2.Curves, surface_curve_3.Curves, surface_curve_4.Curves],
    Count=10,
    Kinks=False)  # -> Points, Tangents, Parameters
scale = Scale(Geometry=deconstruct_brep.Faces, Center=area.Centroid, Factor=Slider(0.9, range=0..1))  # -> Geometry, Transform
explode_tree = ExplodeTree(Data=divide_curve.Points)  # -> Branch0, Branch1, Branch2, Branch3
divide_surface = DivideSurface(Surface=scale.Geometry, UCount=10, VCount=10)  # -> Points, Normals, Parameters
geometry = Geometry(explode_tree.Branch0)
S = Slider(0.05, range=0..0.1)
trim_tree = TrimTree(Tree=divide_surface.Points, Depth=1)
center_box = CenterBox(Base=trim_tree, X=S, Y=S, Z=S)
explode_tree_2 = ExplodeTree(Data=center_box)  # -> Branch0, Branch1, Branch2, Branch3, Branch4, Branch5
point_in_breps = PointInBreps(Brep=explode_tree_2.Branch0, Point=geometry, Strict=False)  # -> Inside, Index
point_in_breps_2 = PointInBreps(Brep=explode_tree_2.Branch1, Point=explode_tree.Branch1, Strict=False)  # -> Inside, Index
point_in_breps_3 = PointInBreps(Brep=explode_tree_2.Branch2, Point=explode_tree.Branch2, Strict=False)  # -> Inside, Index
point_in_breps_4 = PointInBreps(Brep=explode_tree_2.Branch3, Point=explode_tree.Branch3, Strict=False)  # -> Inside, Index
panel_3 = Panel(point_in_breps.Index)
panel_4 = Panel(point_in_breps_2.Index)
panel_5 = Panel(point_in_breps_3.Index)
panel_6 = Panel(point_in_breps_4.Index)

# ---- group: ENCODE
c_script = CSharpScript(x=point_in_breps_2.Index)  # -> out, A; inputs x: list of Int32
# ---------- c_script: C# ----------
    string code = "";
    for (int i = 0; i < x.Count; i++)
    {
     
      string binary = Convert.ToString(x[i], 2);
      code += binary;
    }
    A = code;
# ---------- end c_script ----------

c_script_2 = CSharpScript(x=point_in_breps_3.Index)  # -> out, A; inputs x: list of Int32; same code as c_script

c_script_3 = CSharpScript(x=point_in_breps.Index)  # -> out, A; inputs x: list of Int32; same code as c_script

c_script_4 = CSharpScript(x=point_in_breps_4.Index)  # -> out, A; inputs x: list of Int32; same code as c_script

# ----
panel_7 = Panel(c_script.A)
panel_8 = Panel(c_script_2.A)
panel_9 = Panel(c_script_3.A)
panel_10 = Panel(c_script_4.A)

# ---- group: Compare strings
c_script_5 = CSharpScript(x=c_script_3.A, y=panel_8)  # -> out, A; inputs x: String, y: String
# ---------- c_script_5: C# ----------
    A = x.Equals(y);
# ---------- end c_script_5 ----------

c_script_6 = CSharpScript(x=c_script_3.A, y=c_script_2.A)  # -> out, A; inputs x: String, y: String; same code as c_script_5

# ---- group: List of encoded values for each face
merge = Merge(Data1=c_script_3.A, Data2=c_script.A, Data3=c_script_2.A, Data4=c_script_4.A, Data5="-1", Data6="-1")  # -> flatten(Result)

# ----
panel_11 = Panel(c_script_6.A)
panel_12 = Panel(c_script_5.A)
reverse_list = ReverseList(List=merge)
panel_13 = Panel(reverse_list)
