# Grasshopper definition Voxel_03.gh (Grasshopper 1.0.7)

surface = Surface([<surface referenced from the Rhino model> x4])
brep = Brep([<brep referenced from the Rhino model> x4])
mesh = Mesh(surface)
c_script = CSharpScript(Voxels=brep, Chuncks=mesh)  # -> out, Binary, Hexa_1, Hexa_2, Hexa_3, Hexa_4; inputs Voxels: list of Brep, Chuncks: list of Mesh
# ---------- c_script: C# usings ----------
using System.Text;
# ---------- c_script: C# ----------
    double num0 = 0;
    double num1 = 0;

    List <string> Codes = new List <string>();
    List <string> Hexacodes0 = new List <string>();
    List <string> Hexacodes1 = new List <string>();
    List <string> Hexacodes2 = new List <string>();
    List <string> Hexacodes3 = new List <string>();



    for (int i = 0; i < Voxels.Count; i++)
    {
      //make new encoding strings
      String code = "";
      //string eleni = "";


      //make a new tree for every voxel
      DataTree <Point3d> DivTree = new DataTree<Point3d>();
      DataTree <Point3d> ClosestTree = new DataTree<Point3d>();
      DataTree <int> BoolsTree = new DataTree<int>();

      List<Surface> faces = new List<Surface>();
      faces.AddRange(Voxels[i].Surfaces);

      for (int j = 0; j < faces.Count; j++)
      {

        //one list for every face
        List <Point3d> DivPts = new List<Point3d>();



        var dom0 = faces[j].Domain(0).Length;
        var dom1 = faces[j].Domain(1).Length;
        num0 = dom0 / 9;
        num1 = dom1 / 9;


        var myU = new Interval(faces[j].Domain(0).Min, faces[j].Domain(0).Max);
        var myV = new Interval(faces[j].Domain(1).Min, faces[j].Domain(1).Max);

        for (int k = 0; k < 10; k++)
        {
          for (int l = 0; l < 10; l++)
          {
            Point3d temp = faces[j].PointAt(myU[0] + (num0 * k), myV[0] + (num1 * l));
            DivPts.Add(temp);
          }
        }
        DivTree.AddRange(DivPts, new GH_Path(new int[] { j, 0 }));

        //mesh intersection between the chunck and the points of the faces
        for (int m = 0; m < DivTree.BranchCount; m++)
        {
          List<Point3d> ClosestPts = new List <Point3d >();
          for (int e = 0; e < DivTree.Branch(m).Count; e++)
          {
            for (int f = 0; f < Chuncks.Count; f++)
            {
			            ClosestPts.Add(Chuncks[f].ClosestPoint(DivTree.Branch(m)[e]));
            }
         
            
          }
           ClosestTree.AddRange(ClosestPts, new GH_Path(new int[] { m, 0 }));
         
        }


          
        //Create the true false list
        for (int p = 0; p < DivTree.BranchCount; p++)
        {
           List<int> Bools = new List<int>();
       
          for (int q = 0; q < DivTree.Branch(p).Count; q++)
          {
            if(DivTree.Branch(p)[q].DistanceTo(ClosestTree.Branch(p)[q]) <= (num0 / 2))
              Bools.Add(1);
            else
              Bools.Add(0);
          }
          BoolsTree.AddRange(Bools, new GH_Path(new int[] { p, 0 }));
        }


        for (int x = 0; x < BoolsTree.BranchCount; x++)
        {
          code = "";
          for (int z = 0; z < BoolsTree.Branch(x).Count; z++)
          {
            code += BoolsTree.Branch(x)[z];
          }
        }
        Codes.Add(code);

      }



      string eleos0 = ToHexString(code);
      string eleos1 = ToOtherHexStrng(code);
      string eleos2 = Data_Hex_Asc(code);

      Hexacodes0.Add(eleos0);
      Hexacodes1.Add(eleos1);
      Hexacodes2.Add(eleos2);
      //Hexacodes3.Add(eleni);


    }

    Binary = Codes;
    // Hexa_1 = Hexacodes0;
    // Hexa_2 = Hexacodes1;
    // Hexa_3 = Hexacodes2;
    //Hexa_4 = Hexacodes3;
# ---------- c_script: C# additional code ----------
  List <Point3d> DivPts ;
  List <Point3d> ClosestPts ;
  List<int> Bools;


  public static string ToHexString(string str)
  {
    var sb = new StringBuilder();

    var bytes = Encoding.Unicode.GetBytes(str);
    foreach (var t in bytes)
    {
      sb.Append(t.ToString("X2"));
    }

    return sb.ToString();
  }


  public static string ToOtherHexStrng(string str)
  {
    byte[] ba = Encoding.Default.GetBytes(str);


    string hexString = BitConverter.ToString(ba);

    return hexString;
  }
  public string Data_Hex_Asc(string Data)
  {
    string Data1 = "";
    string sData = "";
    while (Data.Length > 0)
      //first take two hex value using substring.
      //then convert Hex value into ascii.
      //then convert ascii value into character.
    {
      Data1 = System.Convert.ToChar(System.Convert.ToUInt32(Data.Substring(0, 2), 16)).ToString();
      sData = sData + Data1;
      Data = Data.Substring(2, Data.Length - 2);
    }
    return sData;
  }
# ---------- end c_script ----------
param_viewer = ParamViewer(c_script.Binary)
panel = Panel(c_script.Hexa_1)
panel_2 = Panel(c_script.Hexa_3)
panel_3 = Panel(c_script.Hexa_2)
panel_4 = Panel(c_script.Hexa_4)
panel_5 = Panel(c_script.Binary)
number_slider = Slider(6, range=0..10)
split_list = SplitList(List=c_script.Binary, Index=number_slider)  # -> ListA, ListB
split_list_2 = SplitList(List=split_list.ListB, Index=number_slider)  # -> ListA, ListB
split_list_3 = SplitList(List=split_list_2.ListB, Index=number_slider)  # -> ListA, ListB
split_list_4 = SplitList(List=split_list_3.ListB, Index=number_slider)  # -> ListA, ListB
text_join = TextJoin(Text=split_list_2.ListA)
text_join_2 = TextJoin(Text=split_list_3.ListA)
text_join_3 = TextJoin(Text=split_list.ListA)
text_join_4 = TextJoin(Text=split_list_4.ListA)
ghpython_script = GhPythonScript(x=text_join_3)  # -> out, a
# ---------- ghpython_script: Python ----------
__author__ = "Eleni"
__version__ = "2020.06.24"

import rhinoscriptsyntax as rs

a = hex(int(x, 2))
# ---------- end ghpython_script ----------
ghpython_script_2 = GhPythonScript(x=text_join)  # -> out, a; same code as ghpython_script
ghpython_script_3 = GhPythonScript(x=text_join_4)  # -> out, a; same code as ghpython_script
ghpython_script_4 = GhPythonScript(x=text_join_2)  # -> out, a; same code as ghpython_script
panel_6 = Panel(ghpython_script.a)
panel_7 = Panel(ghpython_script_2.a)
panel_8 = Panel(ghpython_script_3.a)
panel_9 = Panel(ghpython_script_4.a)
