# Grasshopper definition how the encoder works internally 3 ways.gh (Grasshopper 1.0.7)

number_slider = Slider(100, range=0..100)

# ---- group: surf chunk
brep = Brep(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)

# ---- group: box
# Get the faces of the voxel and all the edges of the chunck
# for every face
#   for every edge
#       check intersection
#       if intersects
#       associate the edge with the       face
#       divide the face into points
brep_2 = Brep(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)

# ----
series = Series(Start=Slider(0, range=0..100), Step=number_slider, Count=Slider(6, range=0..10))

# ---- group: surf chunk
brep_3 = Brep(<brep referenced from the Rhino model>)

# ---- group: box
brep_4 = Brep(<brep referenced from the Rhino model>)

# ----
deconstruct_brep = DeconstructBrep(Brep=brep_4)  # -> Faces, Edges, Vertices
deconstruct_brep_2 = DeconstructBrep(Brep=brep_3)  # -> Faces, Edges, Vertices
mesh = Mesh(brep_3)
geometry = Geometry(brep_4)

uv = Slider(9, range=0..10)
divide_surface = DivideSurface(Surface=reparameterize(graft(deconstruct_brep.Faces)), UCount=uv, VCount=uv)  # -> Points, Normals, Parameters

c_script = CSharpScript(Voxels=geometry, Chuncks=mesh)  # -> out, Binary, Hexa_1, Hexa_2, Hexa_3, Hexa_4; inputs Voxels: list of Brep, Chuncks: list of Mesh
# ---------- c_script: C# usings ----------
using System.Text;
# ---------- c_script: C# ----------
    double num0 = 0;
    double num1 = 0;

    List <string> Codes = new List <string>();
    List <string> Hexacodes0 = new List <string>();
    List <string> Hexacodes1 = new List <string>();
    List <string> Hexacodes2 = new List <string>();
    List <string> Hexacodes3 = new List <string>();




    for (int i = 0; i < Voxels.Count; i++)
    {
      //make new encoding strings
      String code = "";
      //string eleni = "";


      //make a new tree for every voxel
      DataTree <Point3d> DivTree = new DataTree<Point3d>();
      DataTree <Point3d> ClosestTree = new DataTree<Point3d>();
      DataTree <int> BoolsTree = new DataTree<int>();

      List<Surface> faces = new List<Surface>();
      faces.AddRange(Voxels[i].Surfaces);

      for (int j = 0; j < faces.Count; j++)
      {
        //one list for every face
        DivPts = new List<Point3d>();



        var dom0 = faces[j].Domain(0).Length;
        var dom1 = faces[j].Domain(1).Length;
        num0 = dom0 / 9;
        num1 = dom1 / 9;


        var myU = new Interval(faces[j].Domain(0).Min, faces[j].Domain(0).Max);
        var myV = new Interval(faces[j].Domain(1).Min, faces[j].Domain(1).Max);

        for (int k = 0; k < 10; k++)
        {
          for (int l = 0; l < 10; l++)
          {
            Point3d temp = faces[j].PointAt(myU[0] + (num0 * k), myV[0] + (num1 * l));
            DivPts.Add(temp);
          }
        }
        DivTree.AddRange(DivPts, new GH_Path(new int[] { j, 0 }));
      }
      //mesh intersection between the chunck and the points of the faces
      for (int m = 0; m < DivTree.BranchCount; m++)
      {
        ClosestPts = new List <Point3d >();
        for (int e = 0; e < DivTree.Branch(m).Count; e++)
        {
          ClosestPts.Add(Chuncks[i].ClosestPoint(DivTree.Branch(m)[e]));
        }
        ClosestTree.AddRange(ClosestPts, new GH_Path(new int[] { m, 0 }));
      }

      //Create the true false list
      for (int p = 0; p < DivTree.BranchCount; p++)
      {
        Bools = new List<int>();
        for (int q = 0; q < DivTree.Branch(p).Count; q++)
        {
          if(DivTree.Branch(p)[q].DistanceTo(ClosestTree.Branch(p)[q]) <= (num0 / 2))
            Bools.Add(1);
          else
            Bools.Add(0);
        }
        BoolsTree.AddRange(Bools, new GH_Path(new int[] { p, 0 }));
      }


      for (int x = 0; x < BoolsTree.BranchCount; x++)
      {

        for (int z = 0; z < BoolsTree.Branch(x).Count; z++)
        {
          code += BoolsTree.Branch(x)[z];
        }
      }
      Codes.Add(code);



      string eleos0 = ToHexString(code);
      string eleos1 = ToOtherHexStrng(code);
      string eleos2 = Data_Hex_Asc(code);

      Hexacodes0.Add(eleos0);
      Hexacodes1.Add(eleos1);
      Hexacodes2.Add(eleos2);
      //Hexacodes3.Add(eleni);


    }

    Binary = Codes;
    Hexa_1 = Hexacodes0;
    Hexa_2 = Hexacodes1;
    Hexa_3 = Hexacodes2;
    Hexa_4 = Hexacodes3;
# ---------- c_script: C# additional code ----------
  List <Point3d> DivPts ;
  List <Point3d> ClosestPts ;
  List<int> Bools;


  public static string ToHexString(string str)
  {
    var sb = new StringBuilder();

    var bytes = Encoding.Unicode.GetBytes(str);
    foreach (var t in bytes)
    {
      sb.Append(t.ToString("X2"));
    }

    return sb.ToString();
  }


  public static string ToOtherHexStrng(string str)
  {
    byte[] ba = Encoding.Default.GetBytes(str);


    string hexString = BitConverter.ToString(ba);

    return hexString;
  }
  public string Data_Hex_Asc(string Data)
  {
    string Data1 = "";
    string sData = "";
    while (Data.Length > 0)
      //first take two hex value using substring.
      //then convert Hex value into ascii.
      //then convert ascii value into character.
    {
      Data1 = System.Convert.ToChar(System.Convert.ToUInt32(Data.Substring(0, 2), 16)).ToString();
      sData = sData + Data1;
      Data = Data.Substring(2, Data.Length - 2);
    }
    return sData;
  }
# ---------- end c_script ----------
list_item = ListItem(List=c_script.Binary, Index=Slider(0, range=0..100), Wrap=True)
panel = Panel(list_item)
text_fragment = TextFragment(Text=panel, Start=series, Count=number_slider)
panel_2 = Panel(text_fragment)
panel_3 = Panel(divide_surface.Points)
text_length = TextLength(Text=text_fragment)
param_viewer = ParamViewer(divide_surface.Points)
panel_4 = Panel(c_script.Binary)
panel_5 = Panel(c_script.Hexa_1)
panel_6 = Panel(c_script.Hexa_3)
panel_7 = Panel(c_script.Hexa_2)
panel_8 = Panel(c_script.Hexa_4)
S = Slider(0.05, range=0..0.1)

mesh_closest_point = MeshClosestPoint(Point=divide_surface.Points, Mesh=brep_3)  # -> Point, Index, Parameter
distance = Distance(PointA=mesh_closest_point.Point, PointB=divide_surface.Points)
smaller_than = SmallerThan(FirstNumber=distance, SecondNumber=S)  # -> SmallerThan, OrEqualTo
cull_pattern = CullPattern(List=divide_surface.Points, CullPattern=smaller_than.SmallerThan)

custom_preview = CustomPreview(Geometry=[divide_surface.Points, mesh_closest_point.Point], Material=ColourSwatch(SwatchColor=RGB(110, 110, 110)))
center_box = CenterBox(Base=divide_surface.Points, X=S, Y=S, Z=S)
ghpython_script = GhPythonScript(x=panel_2)  # -> out, graft(a)
# ---------- ghpython_script: Python ----------
__author__ = "Eleni"
__version__ = "2020.06.24"

import rhinoscriptsyntax as rs

a = hex(int(x, 2))
# ---------- end ghpython_script ----------
c_script_2 = CSharpScript(x=panel_2)  # -> out, A; inputs x: list of String
# ---------- c_script_2: C# ----------
    foreach (var input in x)
    {
      A = input;
     // int output = Convert.ToInt32(input, 16);

    }
# ---------- end c_script_2 ----------
collision_one_many = CollisionOneMany(Collider=center_box, Obstacles=flatten(brep_3))  # -> Collision, Index
panel_9 = Panel(c_script_2.out)
panel_10 = Panel(c_script_2.A)
number = Number(collision_one_many.Collision)
text_join = TextJoin(Text=number)
panel_11 = Panel(ghpython_script.a)
param_viewer_2 = ParamViewer(smaller_than.SmallerThan)
shift_paths = ShiftPaths(Data=text_join, Offset=-1)
text_join_2 = TextJoin(Text=shift_paths)
number_2 = Number(smaller_than.SmallerThan)
panel_12 = Panel(number_2)
ghpython_script_2 = GhPythonScript(x=text_join_2)  # -> out, a; same code as ghpython_script
text_join_3 = TextJoin(Text=number_2)
panel_13 = Panel(ghpython_script_2.a)
text_join_4 = TextJoin(Text=flatten(text_join_2))
text_join_5 = TextJoin(Text=flatten(ghpython_script_2.a))
shift_paths_2 = ShiftPaths(Data=text_join_3, Offset=-1)
panel_14 = Panel(text_join_4)
panel_15 = Panel(text_join_5)
text_join_6 = TextJoin(Text=shift_paths_2)
panel_16 = Panel(text_join_6)
ghpython_script_3 = GhPythonScript(x=text_join_6)  # -> out, a; same code as ghpython_script
text_join_7 = TextJoin(Text=flatten(text_join_6))
text_join_8 = TextJoin(Text=flatten(ghpython_script_3.a))
panel_18 = Panel(text_join_8)

list_item_2 = ListItem(List=deconstruct_brep.Faces, Index=Slider(0, range=0..100), Wrap=True)  # -> Item, Item1, Item2, Item3, Item4, Item5
surface_curve = SurfaceCurve(Surface=list_item_2.Item, Curve=deconstruct_brep_2.Edges)  # -> flatten(Curves), Points, UVPoints, Normals, Parameters, Tangents
surface_curve_2 = SurfaceCurve(Surface=list_item_2.Item1, Curve=deconstruct_brep_2.Edges)  # -> flatten(Curves), Points, UVPoints, Normals, Parameters, Tangents
surface_curve_3 = SurfaceCurve(Surface=list_item_2.Item2, Curve=deconstruct_brep_2.Edges)  # -> flatten(Curves), Points, UVPoints, Normals, Parameters, Tangents
surface_curve_4 = SurfaceCurve(Surface=list_item_2.Item3, Curve=deconstruct_brep_2.Edges)  # -> flatten(Curves), Points, UVPoints, Normals, Parameters, Tangents
surface_curve_5 = SurfaceCurve(Surface=list_item_2.Item4, Curve=deconstruct_brep_2.Edges)  # -> flatten(Curves), Points, UVPoints, Normals, Parameters, Tangents
surface_curve_6 = SurfaceCurve(Surface=list_item_2.Item5, Curve=deconstruct_brep_2.Edges)  # -> flatten(Curves), Points, UVPoints, Normals, Parameters, Tangents
colour_swatch = ColourSwatch(SwatchColor=RGB(255, 255, 255))
panel_19 = Panel(surface_curve_5.Curves)
panel_20 = Panel(surface_curve_6.Curves)
divide_curve = DivideCurve(
    Curve=[surface_curve.Curves, surface_curve_2.Curves, surface_curve_3.Curves, surface_curve_4.Curves],
    Count=10,
    Kinks=False)  # -> Points, Tangents, Parameters
area = Area(Geometry=deconstruct_brep.Faces)  # -> Area, Centroid
explode_tree = ExplodeTree(Data=divide_curve.Points)  # -> Branch0, Branch1, Branch2, Branch3
number_slider_2 = Slider(9, range=0..10)
scale = Scale(Geometry=deconstruct_brep.Faces, Center=area.Centroid, Factor=Slider(0.9, range=0..1))  # -> Geometry, Transform
S_2 = Slider(0.05, range=0..0.1)
divide_surface_2 = DivideSurface(Surface=scale.Geometry, UCount=number_slider_2, VCount=number_slider_2)  # -> Points, Normals, Parameters
trim_tree = TrimTree(Tree=divide_surface_2.Points, Depth=1)
center_box_2 = CenterBox(Base=trim_tree, X=S_2, Y=S_2, Z=S_2)
explode_tree_2 = ExplodeTree(Data=center_box_2)  # -> Branch0, Branch1, Branch2, Branch3, Branch4, Branch5
geometry_2 = Geometry(explode_tree_2.Branch0)
point_in_breps = PointInBreps(Brep=explode_tree_2.Branch3, Point=explode_tree.Branch3, Strict=False)  # -> Inside, Index
point_in_breps_2 = PointInBreps(Brep=explode_tree_2.Branch2, Point=explode_tree.Branch2, Strict=False)  # -> Inside, Index
point_in_breps_3 = PointInBreps(Brep=explode_tree_2.Branch0, Point=explode_tree.Branch0, Strict=False)  # -> Inside, Index
point_in_breps_4 = PointInBreps(Brep=explode_tree_2.Branch1, Point=explode_tree.Branch1, Strict=False)  # -> Inside, Index
panel_21 = Panel(point_in_breps.Index)
panel_22 = Panel(point_in_breps_3.Index)
panel_23 = Panel(point_in_breps_4.Index)
panel_24 = Panel(point_in_breps_2.Index)

# ---- group: ENCODE
c_script_3 = CSharpScript(x=point_in_breps_4.Index)  # -> out, A; inputs x: list of Int32
# ---------- c_script_3: C# ----------
    string code = "";
    for (int i = 0; i < x.Count; i++)
    {
     
      string binary = Convert.ToString(x[i], 2);
      code += binary;
    }
    A = code;
# ---------- end c_script_3 ----------

c_script_4 = CSharpScript(x=point_in_breps_2.Index)  # -> out, A; inputs x: list of Int32; same code as c_script_3

c_script_5 = CSharpScript(x=point_in_breps.Index)  # -> out, A; inputs x: list of Int32; same code as c_script_3

c_script_6 = CSharpScript(x=point_in_breps_3.Index)  # -> out, A; inputs x: list of Int32; same code as c_script_3

# ---- group: Compare strings
c_script_7 = CSharpScript(x=c_script_6.A, y=c_script_4.A)  # -> out, A; inputs x: String, y: String
# ---------- c_script_7: C# ----------
    A = x.Equals(y);
# ---------- end c_script_7 ----------

# ---- group: List of encoded values for each face
merge = Merge(Data1=c_script_6.A, Data2=c_script_3.A, Data3=c_script_4.A, Data4=c_script_5.A, Data5="-1", Data6="-1")  # -> flatten(Result)

# ----
panel_25 = Panel(c_script_3.A)
panel_26 = Panel(c_script_4.A)
panel_27 = Panel(c_script_6.A)
panel_28 = Panel(c_script_5.A)
panel_29 = Panel(c_script_7.A)
reverse_list = ReverseList(List=merge)
panel_30 = Panel(reverse_list)

# ---- group: Compare strings
c_script_8 = CSharpScript(x=c_script_6.A, y=panel_26)  # -> out, A; inputs x: String, y: String; same code as c_script_7

# ----
panel_31 = Panel(c_script_8.A)
