# Grasshopper definition simple input.gh (Grasshopper 1.0.7)
# plug-ins: MeshEdit Components, Thesistheamazingtwo

# ---- group: GEOMETRIES
geometry = Geometry([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])

# ---- group: VOXELS
geometry_2 = Geometry([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])

# ----
area = Area(Geometry=geometry_2)  # -> Area, Centroid
encoder = Encoder(InputVoxels=geometry_2, InputChuncks=geometry)  # -> BinaryCodes, UniqueBinaryCodes, EncodedList
bounds = Bounds(Numbers=encoder.EncodedList)
deconstruct_domain = DeconstructDomain(Domain=bounds)  # -> Start, End
gradient = Gradient(
    LowerLimit=deconstruct_domain.Start,
    UpperLimit=deconstruct_domain.End,
    Parameter=encoder.EncodedList,
    stops=[0: RGB(234, 38, 0), 0.25: RGB(234, 126, 0), 0.5: RGB(254, 244, 84), 0.75: RGB(173, 203, 249), 1: RGB(75, 107, 169)])
text_tag = TextTag(Location=area.Centroid, Text=encoder.EncodedList, Colour=ColourSwatch(SwatchColor=RGB(143, 0, 255)))
panel = Panel(encoder.UniqueBinaryCodes)
panel_2 = Panel(encoder.BinaryCodes)
panel_3 = Panel(encoder.EncodedList)
custom_preview = CustomPreview(Geometry=geometry, Material=gradient)
number_slider = Slider(1, range=0..100)
vector_xyz = VectorXYZ(XComponent=Slider(6, range=0..10), YComponent=Slider(6, range=0..10), ZComponent=Slider(1, range=0..10))  # -> Vector, Length
number_slider_2 = Slider(2, range=1..10)
vector_xyz_2 = VectorXYZ(XComponent=Slider(4, range=0..100), YComponent=Slider(4, range=0..100), ZComponent=number_slider_2)  # -> Vector, Length
timer = Timer(TimerInterval=20, Target=model_synthesis2)  # disabled
model_synthesis2 = ModelSynthesis2(
    InputModel=geometry_2,
    InputValues=encoder.EncodedList,
    PatternSize=number_slider_2,
    InputSize=vector_xyz_2.Vector,
    OutputSize=vector_xyz.Vector,
    Probabilistic=Toggle(True),
    Periodic=Toggle(False),
    RESET=Button())  # -> OutputModel, OutputValues, Patterns, Probabilities, PossibilitiesCount, UniquePatters
panel_4 = Panel(model_synthesis2.OutputValues)
panel_5 = Panel(model_synthesis2.Patterns)
panel_6 = Panel(model_synthesis2.Probabilities)
panel_7 = Panel(model_synthesis2.PossibilitiesCount)
panel_8 = Panel(model_synthesis2.UniquePatters)
# info: Sometimes not all the tiles exist in the output model.This component gives the values that correspond to the unique elements that exist in the output model.It also gives the equivalent voxel ad the equavalent mesh.The 3 list given must have the same number of elements.
collection = Collection(
    OutputValues=model_synthesis2.OutputValues,
    EncodedList=encoder.EncodedList,
    InputVoxels=geometry_2,
    InputChuncks=geometry)  # -> OutputUnique, MeshesFound, VoxelsFound
# info: This component gives all the tiles we will need to fill the output model.If number 3 exist in our output 5 times we will get the equivalent mesh and voxel also 5 times and in the corrent index.
decoder = Decoder(
    OutputModel=model_synthesis2.OutputModel,
    OutputValues=model_synthesis2.OutputValues,
    OutputUnique=collection.OutputUnique,
    MeshesCollection=collection.MeshesFound,
    VoxelsCollection=collection.VoxelsFound)  # -> OutputGeometries, VoxelsCenters
area_2 = Area(Geometry=model_synthesis2.OutputModel)  # -> Area, Centroid
# info: Our geometry is all the tiles that exist in the output model.Our source is the center of their boundary voxels in the input model, our target is the center of their boundary voxels in the output model.
orient = Orient(Geometry=decoder.OutputGeometries, Source=decoder.VoxelsCenters, Target=area_2.Centroid)  # -> Geometry, Transform
gradient_2 = Gradient(
    LowerLimit=deconstruct_domain.Start,
    UpperLimit=deconstruct_domain.End,
    Parameter=model_synthesis2.OutputValues,
    stops=[0: RGB(234, 38, 0), 0.25: RGB(234, 126, 0), 0.5: RGB(254, 244, 84), 0.75: RGB(173, 203, 249), 1: RGB(75, 107, 169)])
r = Slider(3, range=0..100)
unit_x = UnitX(Factor=expr("x*2.4", r))
unit_x_2 = UnitX(Factor=r)
move = Move(Geometry=orient.Geometry, Motion=unit_x)  # -> Geometry, Transform
colour_swatch = ColourSwatch(SwatchColor=RGB(204, 75, 188))
mesh_area = MeshArea(Mesh=move.Geometry)  # -> Area, Centroid
custom_preview_2 = CustomPreview(Geometry=move.Geometry, Material=gradient_2)
text_tag_2 = TextTag(Location=mesh_area.Centroid, Text=model_synthesis2.OutputValues, Colour=ColourSwatch(SwatchColor=RGB(255, 255, 255)))
