# Grasshopper definition without backtrack.gh (Grasshopper 1.0.7)
# plug-ins: MeshEdit Components, Thesistheamazingtwo, Human

number_slider = Slider(16, range=0..100)
plane_surface = PlaneSurface(Plane=PlaneXY(0, 0, 0), XSize="0 to 1", YSize="0 to 1")  # -> reparameterize(Plane)
divide_domain² = DivideDomain²(Domain=plane_surface, UCount=number_slider, VCount=number_slider)
isotrim = Isotrim(Surface=plane_surface, Domain=divide_domain²)
area = Area(Geometry=isotrim)  # -> Area, Centroid

# ---- group: VOXELS
geometry = Geometry([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])

# ---- group: GEOMETRIES
geometry_2 = Geometry([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])

# ----
area_2 = Area(Geometry=geometry)  # -> Area, Centroid
image_sampler = ImageSampler(
    area.Centroid,
    FilePath="C:\Users\Eleni\Desktop\LessRooms.png",
    Filter="Colour",
    Interpolate=False,
    Umax=1,
    Umin=0,
    Vmax=1,
    Vmin=0,
    Wrap=1)
encoder = Encoder(InputVoxels=geometry, InputChuncks=geometry_2)  # -> BinaryCodes, UniqueBinaryCodes, EncodedList
bounds = Bounds(Numbers=encoder.EncodedList)
deconstruct_domain = DeconstructDomain(Domain=bounds)  # -> Start, End
domain_box = DomainBox(Base=PlaneXY(0, 0, 0), X="1", Y="1", Z="1")
gradient = Gradient(
    LowerLimit=deconstruct_domain.Start,
    UpperLimit=deconstruct_domain.End,
    Parameter=encoder.EncodedList,
    stops=[0: RGB(243, 57, 0), 0.1: RGB(236, 27, 60), 0.2: RGB(210, 0, 118), 0.3: RGB(103, 0, 120), 0.4: RGB(39, 72, 161), 0.5: RGB(1, 192, 229), 0.6: RGB(18, 178, 90), 0.7: RGB(79, 186, 8), 0.8: RGB(220, 237, 32), 0.9: RGB(247, 159, 20), 1: RGB(243, 57, 0)])
box_array = BoxArray(Geometry=domain_box, Cell=domain_box, XCount=number_slider, YCount=number_slider, ZCount="1")  # -> Geometry, Transform
text_tag = TextTag(Location=area_2.Centroid, Text=encoder.EncodedList, Colour=ColourSwatch(SwatchColor=RGB(255, 255, 255)))
split_argb = SplitARGB(Colour=image_sampler, IntegerChannels=True)  # -> Alpha, Red, Green, Blue
panel = Panel(encoder.UniqueBinaryCodes)
panel_2 = Panel(encoder.BinaryCodes)
panel_3 = Panel(encoder.EncodedList)
construct_point = ConstructPoint(XCoordinate=0, YCoordinate=0, ZCoordinate=Slider(2, range=0..10))
custom_preview = CustomPreview(Geometry=box_array.Geometry, Material=image_sampler)
custom_preview_2 = CustomPreview(Geometry=geometry_2, Material=gradient)  # disabled
z_count = ZCount(1)
addition = Addition(A=split_argb.Red, B=1)
number_slider_2 = Slider(3, range=1..10)
domain_box_2 = DomainBox(Base=construct_point, X=number_slider_2, Y=number_slider_2, Z=Domain(0, 0.25))
number_slider_3 = Slider(16, range=0..100)
division = Division(A=number_slider_3, B=number_slider_2)
number_slider_4 = Slider(16, range=0..100)
division_2 = Division(A=number_slider_4, B=number_slider_2)
number_slider_5 = Slider(2, range=0..100)
number_slider_6 = Slider(20, range=0..20)
number_slider_7 = Slider(20, range=0..20)
box_array_2 = BoxArray(Geometry=domain_box_2, Cell=domain_box_2, XCount=division, YCount=division_2, ZCount=z_count)  # -> Geometry, Transform

integer = Integer(encoder.EncodedList)
box = Box(geometry)

integer_2 = Integer(addition)
box_2 = Box(box_array.Geometry)

brep_edges = BrepEdges(Brep=box_array_2.Geometry)  # -> Naked, Interior, NonManifold
boolean_toggle = BooleanToggle(True)
vector_xyz = VectorXYZ(XComponent=number_slider_6, YComponent=number_slider_7, ZComponent=Slider(1, range=0..10))  # -> Vector, Length
vector_xyz_2 = VectorXYZ(XComponent=number_slider_3, YComponent=number_slider_4, ZComponent=number_slider_2)  # -> Vector, Length
boolean_toggle_2 = BooleanToggle(True)
colour_swatch = ColourSwatch(SwatchColor=RGB(255, 0, 0))
timer = Timer(TimerInterval=500, Target=model_synthesis2)  # disabled
custom_preview_lineweights = CustomPreviewLineweights(Geometry=brep_edges.Interior, Shader=colour_swatch, Thickness=Slider(5.36, range=0..10), Absolute=False)
model_synthesis2 = ModelSynthesis2(
    InputModel=box_2,
    InputValues=integer_2,
    PatternSize=number_slider_2,
    InputSize=vector_xyz_2.Vector,
    OutputSize=vector_xyz.Vector,
    Probabilistic=boolean_toggle_2,
    Periodic=boolean_toggle,
    RESET=Button())  # -> OutputModel, OutputValues, Patterns, Probabilities, PossibilitiesCount, UniquePatters; disabled
model_synthesis = ModelSynthesis(
    InputModel=box_2,
    InputValues=integer_2,
    PatternSize=number_slider_2,
    InputSize=vector_xyz_2.Vector,
    OutputSize=vector_xyz.Vector,
    Probabilistic=boolean_toggle_2,
    Periodic=boolean_toggle,
    Generate=Button())  # -> OutputModel, OutputValues, Patterns, Probabilities
number_slider_8 = Slider(5, range=0..10)
number_slider_9 = Slider(4, range=0..10)
r = Slider(22, range=0..100)
subtraction = Subtraction(A=model_synthesis.OutputValues, B=1)
unit_x = UnitX(Factor=r)
boolean_toggle_3 = BooleanToggle(False)
colour_rgb = ColourRGB(Alpha=255, Red=subtraction, Green=subtraction, Blue=subtraction)
box_array_3 = BoxArray(Geometry=domain_box_2, Cell=domain_box_2, XCount=number_slider_6, YCount=number_slider_7, ZCount=z_count)  # -> Geometry, Transform
move = Move(Geometry=model_synthesis.OutputModel, Motion=unit_x)  # -> Geometry, Transform
division_3 = Division(A="1", B=2)
brep_edges_2 = BrepEdges(Brep=box_array_3.Geometry)  # -> Naked, Interior, NonManifold
negative = Negative(Value=division_3)
stream_filter = StreamFilter(Gate=boolean_toggle_3, Stream1=model_synthesis2.PossibilitiesCount)
stream_filter_2 = StreamFilter(Gate=boolean_toggle_3, Stream1=model_synthesis2.UniquePatters)
stream_filter_3 = StreamFilter(Gate=boolean_toggle_3, Stream0=model_synthesis.Probabilities, Stream1=model_synthesis2.Probabilities)
stream_filter_4 = StreamFilter(Gate=boolean_toggle_3, Stream0=model_synthesis.Patterns, Stream1=model_synthesis2.Patterns)
stream_filter_5 = StreamFilter(Gate=boolean_toggle_3, Stream0=model_synthesis.OutputModel, Stream1=model_synthesis2.OutputModel)
stream_filter_6 = StreamFilter(Gate=boolean_toggle_3, Stream0=model_synthesis.OutputValues, Stream1=model_synthesis2.OutputValues)
custom_preview_3 = CustomPreview(Geometry=move.Geometry, Material=colour_rgb)
vector_xyz_3 = VectorXYZ(XComponent=negative, YComponent=negative, ZComponent=0)  # -> Vector, Length
# info: Sometimes not all the tiles exist in the output model.This component gives the values that correspond to the unique elements that exist in the output model.It also gives the equivalent voxel ad the equavalent mesh.The 3 list given must have the same number of elements.
collection = Collection(OutputValues=stream_filter_6, EncodedList=encoder.EncodedList, InputVoxels=geometry, InputChuncks=geometry_2)  # -> OutputUnique, MeshesFound, VoxelsFound; disabled
panel_4 = Panel(stream_filter)
panel_5 = Panel(stream_filter_3)
panel_6 = Panel(stream_filter_2)
panel_7 = Panel(stream_filter_4)
panel_8 = Panel(stream_filter_6)
# info: This component gives all the tiles we will need to fill the output model.If number 3 exist in our output 5 times we will get the equivalent mesh and voxel also 5 times and in the corrent index.
decoder = Decoder(
    OutputModel=stream_filter_5,
    OutputValues=stream_filter_6,
    OutputUnique=collection.OutputUnique,
    MeshesCollection=collection.MeshesFound,
    VoxelsCollection=collection.VoxelsFound)  # -> OutputGeometries, VoxelsCenters; disabled
area_3 = Area(Geometry=stream_filter_5)  # -> Area, Centroid
# info: Our geometry is all the tiles that exist in the output model.Our source is the center of their boundary voxels in the input model, our target is the center of their boundary voxels in the output model.
orient = Orient(Geometry=decoder.OutputGeometries, Source=decoder.VoxelsCenters, Target=area_3.Centroid)  # -> Geometry, Transform
gradient_2 = Gradient(
    LowerLimit=deconstruct_domain.Start,
    UpperLimit=deconstruct_domain.End,
    Parameter=stream_filter_6,
    stops=[0: RGB(243, 57, 0), 0.1: RGB(236, 27, 60), 0.2: RGB(210, 0, 118), 0.3: RGB(103, 0, 120), 0.4: RGB(39, 72, 161), 0.5: RGB(1, 192, 229), 0.6: RGB(18, 178, 90), 0.7: RGB(79, 186, 8), 0.8: RGB(220, 237, 32), 0.9: RGB(247, 159, 20), 1: RGB(243, 57, 0)])
r_2 = Slider(22, range=0..100)
unit_x_2 = UnitX(Factor=expr("x*2.4", r_2))
unit_x_3 = UnitX(Factor=r_2)
move_2 = Move(Geometry=brep_edges_2.Interior, Motion=unit_x_3)  # -> Geometry, Transform
move_3 = Move(Geometry=move_2.Geometry, Motion=vector_xyz_3.Vector)  # -> Geometry, Transform
custom_preview_lineweights_2 = CustomPreviewLineweights(Geometry=move_3.Geometry, Shader=colour_swatch, Thickness=Slider(5.36, range=0..10), Absolute=False)
move_4 = Move(Geometry=orient.Geometry, Motion=unit_x_3)  # -> Geometry, Transform
colour_swatch_2 = ColourSwatch(SwatchColor=RGB(204, 75, 188))
mesh_area = MeshArea(Mesh=move_4.Geometry)  # -> Area, Centroid
custom_preview_4 = CustomPreview(Geometry=move_4.Geometry, Material=gradient_2)
text_tag_2 = TextTag(Location=mesh_area.Centroid, Text=stream_filter_6, Colour=ColourSwatch(SwatchColor=RGB(255, 255, 255)))
